# Grasshopper definition parametric-sandbox-v0.4-modular_build.gh (Grasshopper 1.0.8)
# plug-ins: Pufferfish, LunchBox

gl_setback = Slider(5, range=0..100)
mod_width = Slider(16, range=0..100)
mod_depth = Slider(20, range=0..100)
mod_height = Slider(12, range=0..100)
number_slider = Slider(0.75, range=0..10)
multiplication = Multiplication(A=number_slider, B=Slider(2, range=0..10))
neg = Negative(Value=multiplication)
neg_2 = Negative(Value=number_slider)
neg_3 = Negative(Value=Slider(0.25, range=0..10))
neg_4 = Negative(Value=Slider(0.75, range=0..10))
dom = ConstructDomain(DomainStart=multiplication, DomainEnd=neg)
multiplication_2 = Multiplication(A=gl_setback, B=12)
num = Number(multiplication_2)
cell_rad = Slider(3, range=0..10)
grid_type = Slider(2, range=0..10)
pt = ConstructPoint(XCoordinate=0, YCoordinate=num, ZCoordinate=0)
multiplication_3 = Multiplication(A=mod_width, B=12)
multiplication_4 = Multiplication(A=mod_depth, B=12)
multiplication_5 = Multiplication(A=mod_height, B=12)
pt_2 = Point(pt)
num_2 = Number(multiplication_3)
mod_width_2 = Number(num_2)
division = Division(A=mod_width_2, B=Slider(3, range=0..10))
num_3 = Number(multiplication_4)
addition = Addition(A=num_3, B=num)
num_4 = Number(multiplication_5)
mod_height_2 = Number(num_4)
pt_3 = ConstructPoint(XCoordinate=0, YCoordinate=0, ZCoordinate=num_4)
pt_4 = Point(pt_3)
rectangle = Rectangle(Plane=pt_4, XSize=num_2, YSize=addition, Radius=0)  # -> Rectangle, Length
rectangle_2 = Rectangle(Plane=pt_2, XSize=num_2, YSize=num_3, Radius=0)  # -> Rectangle, Length
Z = UnitZ(Factor=num_4)
srf = Surface(rectangle.Rectangle)
X = UnitX(Factor=num_2)
srf_2 = Surface(rectangle_2.Rectangle)
extr = Extrude(Base=srf_2, Direction=Z)
extr_2 = Extrude(Base=srf, Direction=Z)
scale_far = Slider(0.1, range=0..1)
scale_close = Slider(0.6, range=0..1)
attractor = Curve(<curve referenced from the Rhino model>)
unit_count = Slider(3, range=0..10)
mod_lower = Geometry(extr)
mod_upper = Geometry(extr_2)
arrlinear = LinearArray(Geometry=extr_2, Direction=Z, Count=unit_count)  # -> Geometry, Transform
item = ListItem(List=arrlinear.Geometry, Index=0, Wrap=True)
number_slider_2 = Slider(90, range=0..100)
xz = XZPlane(Origin=Point(0, 0, 0))
brec = BoundingRectangle(Geometry=arrlinear.Geometry, Plane=xz, Axis=0, Slide=0, Union=True)  # -> Bounding, DimensionX, DimensionY
fac_width = Number(brec.DimensionX)
fac_height = Number(brec.DimensionY)
rectangle_3 = Rectangle(Plane=PlaneXY(0, 0, 0), XSize=fac_width, YSize=fac_height, Radius=0)  # -> Rectangle, Length
boundpanel = BoundPanel(Bnd=rectangle_3.Rectangle, SheetX=mod_width_2, SheetY=mod_height_2)  # -> Panels; inputs Bnd: Curve, SheetX: Double, SheetY: Double, UseWorldXY: Boolean
# ---------- boundpanel: Python ----------
import Rhino
import scriptcontext as sc
from Rhino.Geometry import Plane, Rectangle3d, Interval

# Inputs:
#   Bnd        : Curve
#   SheetX     : float
#   SheetY     : float
#   UseWorldXY : bool
#
# Output:
#   Panels     : list[Curve]


def _doc_tol():
    if sc.doc:
        return sc.doc.ModelAbsoluteTolerance
    if Rhino.RhinoDoc.ActiveDoc:
        return Rhino.RhinoDoc.ActiveDoc.ModelAbsoluteTolerance
    return 1e-3


def sizes_1d(L, S, tol):
    """
    Fills length L with:
    - as many full sheets S as possible
    - remainder split equally into two end caps
    - full sheets centered between caps
    """
    if S <= tol:
        return [L]

    n_full = int(L // S)
    rem = L - (n_full * S)

    if abs(rem) <= tol:
        return [S] * n_full

    cap = 0.5 * rem

    if cap <= tol:
        return [S] * n_full

    return [cap] + ([S] * n_full) + [cap]


Panels = []

if Bnd is None:
    Panels = []
else:
    tol = _doc_tol()

    # Choose working plane
    if UseWorldXY:
        pl = Plane.WorldXY
    else:
        ok, pl = Bnd.TryGetPlane(tol)
        if not ok:
            pl = Plane.WorldXY

    # Bounding box in chosen plane
    bb = Bnd.GetBoundingBox(pl)

    Lx = bb.Max.X - bb.Min.X
    Ly = bb.Max.Y - bb.Min.Y

    x_sizes = sizes_1d(Lx, float(SheetX), tol)
    y_sizes = sizes_1d(Ly, float(SheetY), tol)

    x0 = bb.Min.X
    for sx in x_sizes:
        y0 = bb.Min.Y
        for sy in y_sizes:
            rect = Rectangle3d(
                pl,
                Interval(x0, x0 + sx),
                Interval(y0, y0 + sy)
            )
            Panels.append(rect.ToNurbsCurve())
            y0 += sy
        x0 += sx
# ---------- end boundpanel ----------
modules = Curve(boundpanel)
boundpanel_2 = BoundPanel(Bnd=boundpanel, SheetX=division, SheetY=mod_height_2)  # -> Panels; inputs Bnd: Curve, SheetX: Double, SheetY: Double, UseWorldXY: Boolean; same code as boundpanel
disc = Discontinuity(Curve=boundpanel_2, Level=1)  # -> Points, Parameters
offset = OffsetCurve(Curve=boundpanel_2, Distance=neg_2, Corners=1)
offset_2 = OffsetCurve(Curve=boundpanel_2, Distance=neg_3, Corners=1)
offset_3 = OffsetCurve(Curve=boundpanel_2, Distance=neg_4, Corners=1)  # -> simplify(Curve)
cullpt = CullDuplicates(Points=disc.Points, Tolerance=0.1, CullMode=1)  # -> Points, Indices, Valence
sdivide = DivideSurface(Surface=offset_3, UCount=Slider(3, range=0..100), VCount=Slider(3, range=0..100))  # -> Points, Normals, Parameters
boundary = BoundarySurfaces(Edges=flatten([offset, boundpanel]))
path_mapper = PathMapper(sdivide.Points, source="{A;B;C;D}", target="{A;B;C}")
incurve = PointInCurve(Point=simplify(path_mapper), Curve=offset_3)  # -> Relationship, Point
rectangle_4 = Rectangle(Plane=cullpt.Points, XSize=dom, YSize=dom, Radius=0)  # -> Rectangle, Length
srfsplit = SurfaceSplit(Surface=simplify(boundary), Curves=simplify(flatten(rectangle_4.Rectangle)))
area = Area(Geometry=rectangle_4.Rectangle)  # -> Area, Centroid
equals = Equality(FirstNumber=incurve.Relationship, SecondNumber=Slider(1, range=0..1))  # -> Equality, Inequality
crv = Curve(offset_2)
area_2 = Area(Geometry=srfsplit)  # -> Area, Centroid
cull = CullPattern(List=path_mapper, CullPattern=equals.Equality)
grid_in_region = GridInRegion(B=crv, RadX=cell_rad, Type=grid_type)  # -> simplify(GridCells), R, C; inputs B: Curve, RadX: Double, RadY: Double, Type: Boolean
# ---------- grid_in_region: Python ----------
import math
import Rhino
from Rhino.Geometry import Point3d, Polyline, PolylineCurve
from Rhino.Geometry.Intersect import Intersection
from Grasshopper import DataTree
from Grasshopper.Kernel.Data import GH_Path

def _is_closed_planar(crv, tol):
    if crv is None: return False
    if not crv.IsClosed: return False
    ok, _ = crv.TryGetPlane(tol)
    return ok

def _curve_plane(crv, tol):
    ok, pln = crv.TryGetPlane(tol)
    return pln if ok else None

def _hex_pts_xy(cx, cy, rx, ry):
    # pointy-top hex; rx stretches X, ry stretches Y
    pts = []
    for k in range(6):
        ang = math.radians(30.0 + 60.0 * k)
        pts.append((cx + rx * math.cos(ang), cy + ry * math.sin(ang)))
    return pts

def _rect_pts_xy(cx, cy, rx, ry):
    # axis-aligned rectangle; if rx==ry it's a square
    return [
        (cx - rx, cy - ry),
        (cx + rx, cy - ry),
        (cx + rx, cy + ry),
        (cx - rx, cy + ry),
    ]

def _poly_fully_inside(cell_crv, boundary, plane, tol):
    ok, pl = cell_crv.TryGetPolyline()
    if not ok:
        return False

    # all vertices must be inside (or on boundary)
    for i in range(pl.Count - 1):
        if boundary.Contains(pl[i], plane, tol) == Rhino.Geometry.PointContainment.Outside:
            return False

    # any intersection (including touching) rejects
    x = Intersection.CurveCurve(cell_crv, boundary, tol, tol)
    if x and x.Count > 0:
        return False

    return True

# ----------------------------
# Main
# ----------------------------
GridCells = []
R = DataTree[object]()  # rows
C = DataTree[object]()  # cols

if B is None or RadX is None:
    GridCells = []
else:
    tol = Rhino.RhinoDoc.ActiveDoc.ModelAbsoluteTolerance if Rhino.RhinoDoc.ActiveDoc else 1e-6

    rx = float(RadX)
    if rx <= 0.0:
        GridCells = []
    else:
        # Critical rule: if RadY == 0 -> regular polygons
        if RadY is None:
            ry = rx
        else:
            ry_in = float(RadY)
            ry = rx if abs(ry_in) <= tol else ry_in

        if not _is_closed_planar(B, tol):
            GridCells = []
        else:
            plane = _curve_plane(B, tol)

            # boundary plane coords -> World XY
            xform_w2p = Rhino.Geometry.Transform.ChangeBasis(plane, Rhino.Geometry.Plane.WorldXY)
            xform_p2w = Rhino.Geometry.Transform.ChangeBasis(Rhino.Geometry.Plane.WorldXY, plane)

            B2 = B.DuplicateCurve()
            B2.Transform(xform_w2p)

            mp = Rhino.Geometry.AreaMassProperties.Compute(B2)
            ctr2 = mp.Centroid if mp else B2.GetBoundingBox(True).Center

            use_hex = True if Type else False

            # Grid spacing derived from rx/ry
            if use_hex:
                dx = math.sqrt(3.0) * rx
                dy = 1.5 * ry
            else:
                dx = 2.0 * rx
                dy = 2.0 * ry

            bb = B2.GetBoundingBox(True)
            minx = bb.Min.X - 2.0 * dx
            maxx = bb.Max.X + 2.0 * dx
            miny = bb.Min.Y - 2.0 * dy
            maxy = bb.Max.Y + 2.0 * dy

            j_min = int(math.floor((miny - ctr2.Y) / dy)) - 1
            j_max = int(math.ceil((maxy - ctr2.Y) / dy)) + 1
            i_min = int(math.floor((minx - ctr2.X) / dx)) - 1
            i_max = int(math.ceil((maxx - ctr2.X) / dx)) + 1

            cells_by_row = {}  # j -> list of (i, curve)
            cells_by_col = {}  # i -> list of (j, curve)

            for j in range(j_min, j_max + 1):
                y = ctr2.Y + j * dy
                row_offset = (0.5 * dx if (use_hex and (j & 1)) else 0.0)

                for i in range(i_min, i_max + 1):
                    x = ctr2.X + i * dx + row_offset
                    cpt2 = Point3d(x, y, 0.0)

                    # quick cull: center must be inside
                    if B2.Contains(cpt2, Rhino.Geometry.Plane.WorldXY, tol) == Rhino.Geometry.PointContainment.Outside:
                        continue

                    # build candidate cell in plane coords (WorldXY)
                    if use_hex:
                        verts = _hex_pts_xy(x, y, rx, ry)
                    else:
                        verts = _rect_pts_xy(x, y, rx, ry)

                    pts = [Point3d(vx, vy, 0.0) for (vx, vy) in verts]
                    pts.append(pts[0])

                    pline = Polyline(pts)
                    if not pline.IsValid:
                        continue

                    cell2 = PolylineCurve(pline)

                    if not _poly_fully_inside(cell2, B2, Rhino.Geometry.Plane.WorldXY, tol):
                        continue

                    cell_w = cell2.DuplicateCurve()
                    cell_w.Transform(xform_p2w)

                    GridCells.append(cell_w)
                    cells_by_row.setdefault(j, []).append((i, cell_w))
                    cells_by_col.setdefault(i, []).append((j, cell_w))

            # Rows -> R (branches ordered by j, items ordered by i)
            row_keys = sorted(cells_by_row.keys())
            for r_idx, j in enumerate(row_keys):
                path = GH_Path(r_idx)
                for (_, crv) in sorted(cells_by_row[j], key=lambda t: t[0]):
                    R.Add(crv, path)

            # Cols -> C (branches ordered by i, items ordered by j)
            col_keys = sorted(cells_by_col.keys())
            for c_idx, i in enumerate(col_keys):
                path = GH_Path(c_idx)
                for (_, crv) in sorted(cells_by_col[i], key=lambda t: t[0]):
                    C.Add(crv, path)
# ---------- end grid_in_region ----------
smaller = SmallerThan(FirstNumber=area.Area, SecondNumber=area_2.Area)  # -> SmallerThan, OrEqualTo
cir = Circle(Plane=cull, Radius=Slider(0.5, range=0..1))
area_3 = Area(Geometry=grid_in_region.GridCells)  # -> Area, Centroid
cull_2 = CullPattern(List=srfsplit, CullPattern=invert(smaller.SmallerThan))
srf_3 = Surface(cir)
crv_2 = Curve(cull_2)
geo = Geometry(flatten(boundary))
curve_attractor = CurveAttractor(C=attractor, P=area_3.Centroid, A=scale_close, B=scale_far)  # -> R, points_on_curve_2
runion = RegionUnion(Curves=flatten(crv_2))
scale = Scale(Geometry=grid_in_region.GridCells, Center=area_3.Centroid, Factor=curve_attractor.R)  # -> Geometry, Transform
X_2 = UnitX(Factor=1)
rot3d = Rotate3D(Geometry=runion, Angle=degrees(number_slider_2), Center=Point(0, 0, 0), Axis=X_2)  # -> Geometry, Transform
rot3d_2 = Rotate3D(Geometry=geo, Angle=degrees(number_slider_2), Center=Point(0, 0, 0), Axis=X_2)  # -> Geometry, Transform
vec = Vector(Z)
move = Move(Geometry=rot3d_2.Geometry, Motion=vec)  # -> Geometry, Transform
move_2 = Move(Geometry=rot3d.Geometry, Motion=vec)  # -> Geometry, Transform
rot3d_3 = Rotate3D(Geometry=flatten(srf_3), Angle=degrees(number_slider_2), Center=Point(0, 0, 0), Axis=X_2)  # -> Geometry, Transform
rot3d_4 = Rotate3D(Geometry=scale.Geometry, Angle=degrees(number_slider_2), Center=Point(0, 0, 0), Axis=X_2)  # -> Geometry, Transform
rot3d_5 = Rotate3D(Geometry=[scale.Geometry, offset_2], Angle=degrees(number_slider_2), Center=Point(0, 0, 0), Axis=X_2)  # -> Geometry, Transform
geo_2 = Geometry(move_2.Geometry)
geo_3 = Geometry(move.Geometry)
move_3 = Move(Geometry=rot3d_5.Geometry, Motion=vec)  # -> Geometry, Transform
move_4 = Move(Geometry=rot3d_3.Geometry, Motion=vec)  # -> Geometry, Transform
srf_4 = Surface(geo_2)
move_5 = Move(Geometry=rot3d_4.Geometry, Motion=vec)  # -> Geometry, Transform
Y = UnitY(Factor=Slider(3, range=0..10))
Y_2 = UnitY(Factor=Slider(1, range=0..10))
panels = Curve(move_3.Geometry)
geo_4 = Geometry(move_4.Geometry)
neg_5 = Negative(Value=Y_2)
extr_3 = Extrude(Base=srf_4, Direction=Y)
extr_4 = Extrude(Base=geo_3, Direction=neg_5)
Y_3 = UnitY(Factor=Slider(0.25, range=0..1))
move_6 = Move(Geometry=flatten([move_5.Geometry, move_3.Geometry]), Motion=neg_5)  # -> Geometry, Transform
neg_6 = Negative(Value=Y_3)
extr_5 = Extrude(Base=geo_4, Direction=neg_6)

mod_ary_upper = Geometry(arrlinear.Geometry)
mod_ary_lower = Geometry(extr)

geo_5 = Geometry(extr_3)
geo_6 = Geometry(extr_4)
geo_7 = Geometry(extr_5)
grid = Curve(move_6.Geometry)

_12 = B(12)
multiplication_6 = Multiplication(A=Slider(25, range=0..100), B=_12)
multiplication_7 = Multiplication(A=Slider(15, range=0..100), B=_12)
rectangle_5 = Rectangle(Plane=PlaneXY(0, 0, 0), XSize=multiplication_6, YSize=multiplication_7, Radius=0)  # -> Rectangle, Length
number_slider_3 = Slider(2, range=0..10)
grid_2 = GridStructure(Surface=rectangle_5.Rectangle, UDivisions=Slider(4, range=0..10), VDivisions=Slider(2, range=0..10))  # -> StructureLines, StructureNodes
neg_7 = Negative(Value=number_slider_3)
_2 = B(2)
neg_8 = Negative(Value=Slider(0.25, range=0..1))
offset_4 = OffsetCurve(Curve=rectangle_5.Rectangle, Distance=neg_7, Corners=1)
srfsplit_2 = SurfaceSplit(Surface=rectangle_5.Rectangle, Curves=grid_2.StructureLines)
division_2 = Division(A=number_slider_3, B=_2)
crv_3 = Curve(srfsplit_2)
offset_5 = OffsetCurve(Curve=crv_3, Distance=neg_8, Corners=1)
neg_9 = Negative(Value=division_2)
brec_2 = BoundingRectangle(Geometry=offset_5, Plane=PlaneXY(0, 0, 0), Axis=0, Slide=0, Union=True)  # -> Bounding, DimensionX, DimensionY
offset_6 = OffsetCurve(Curve=crv_3, Distance=neg_9, Corners=1)
boundary_2 = BoundarySurfaces(Edges=flatten([rectangle_5.Rectangle, offset_4]))
boundary_3 = BoundarySurfaces(Edges=flatten([rectangle_5.Rectangle, offset_6]))
sunion = SolidUnion(Breps=[boundary_3, boundary_2])
grid_in_region_2 = GridInRegion(B=brec_2.Bounding, RadX=Slider(3, range=0..100), Type=Slider(2, range=0..10))  # -> GridCells, R, C; inputs B: Curve, RadX: Double, RadY: Double, Type: Boolean; same code as grid_in_region
geo_8 = Geometry(sunion)
area_4 = Area(Geometry=grid_in_region_2.GridCells)  # -> Area, Centroid
crv_4 = Curve(<curve referenced from the Rhino model>)
Z_2 = UnitZ(Factor=Slider(1.5, range=0..10))
neg_10 = Negative(Value=Z_2)
scale_2 = Scale(Geometry=grid_in_region_2.GridCells, Center=area_4.Centroid, Factor=0.5)  # -> Geometry, Transform
extr_6 = Extrude(Base=geo_8, Direction=neg_10)
geo_9 = Geometry(extr_6)
crv_5 = Curve(brec_2.Bounding)
crv_6 = Curve(scale_2.Geometry)

# ==== cluster CurveAttractor: Utility
C = ClusterInput()
P = ClusterInput()
x = ClusterInput()
A = ClusterInput()
B = ClusterInput()
crv_cp = CurveClosestPoint(Point=P, Curve=C)  # -> Point, Parameter, Distance
dom = ConstructDomain(DomainStart=A, DomainEnd=B)
bnd = Bounds(Numbers=crv_cp.Distance)
remap = RemapNumbers(Value=crv_cp.Distance, Source=bnd, Target=dom)  # -> Mapped, Clipped
R = ClusterOutput(remap.Mapped)
points_on_curve = Point(crv_cp.Point)
points_on_curve_2 = ClusterOutput(points_on_curve)
