# Grasshopper definition parametric-sandbox-v0.6-make2d.gh (Grasshopper 1.0.8)

view = View(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, ViewSource=1)
view_2 = View(<view referenced from the Rhino model>, ViewSource=1)
view_3 = View(<view referenced from the Rhino model>, ViewSource=1)
view_4 = View(view_2, ViewSource=1)
geo = Geometry(<brep referenced from the Rhino model>)
geo_2 = Geometry([<extrusion referenced from the Rhino model> x36])
geo_3 = Geometry([<extrusion referenced from the Rhino model> x9])
geo_4 = Geometry([<extrusion referenced from the Rhino model> x36])
geo_5 = Geometry([<surface referenced from the Rhino model> x9])
make2d = Make2D(Geometry=geo, View=view_4, TangentEdges=False, TangentSeams=False, AutoComputeMake2D=True)  # -> VisibleCurves, VisibleIndex, VisibleType, HiddenCurves, HiddenIndex, HiddenType
make2d_2 = Make2D(Geometry=geo_3, View=view_4, TangentEdges=False, TangentSeams=False, AutoComputeMake2D=True)  # -> VisibleCurves, VisibleIndex, VisibleType, HiddenCurves, HiddenIndex, HiddenType
make2d_3 = Make2D(Geometry=geo_4, View=view_4, TangentEdges=False, TangentSeams=False, AutoComputeMake2D=True)  # -> VisibleCurves, VisibleIndex, VisibleType, HiddenCurves, HiddenIndex, HiddenType
make2d_4 = Make2D(Geometry=geo_2, View=view_4, TangentEdges=False, TangentSeams=False, AutoComputeMake2D=True)  # -> VisibleCurves, VisibleIndex, VisibleType, HiddenCurves, HiddenIndex, HiddenType
make2d_5 = Make2D(Geometry=geo_5, View=view_4, TangentEdges=False, TangentSeams=False, AutoComputeMake2D=False)  # -> VisibleCurves, VisibleIndex, VisibleType, HiddenCurves, HiddenIndex, HiddenType
crv = Curve(make2d.VisibleCurves)
crv_2 = Curve(make2d_2.VisibleCurves)
crv_3 = Curve(make2d_3.VisibleCurves)
crv_4 = Curve(make2d_4.VisibleCurves)
crv_5 = Curve(make2d_5.VisibleCurves)
xz = XZPlane(Origin=Point(0, 0, 0))
pt = Point(Point(0, 1, 0))
mshadow = MeshShadow(Mesh=geo_5, Light=pt, Plane=xz)
