# Grasshopper definition parametric-sandbox-v3.0.gh (Grasshopper 1.0.8)
# plug-ins: Pufferfish

bound_offset = Number(18)
level_count = Number(3)
bounds_x = Number(240)
bounds_y = Number(180)

pattern_offset = Number(0.5)
panel_offset = Number(0.25)
panel_x = Number(60)
panel_y = Number(90)

facade_offset = Number(6)

window_x = Number(60)
window_y = Number(90)

update = Button()
path = FilePath("C:\Users\fharker\Documents\GitHub-Local\parametric-sandbox\1_sandbox\parametric-sandbox-v2.0.csv")
panel = Panel(path)
mullion_offset = Number(1)
prtrl2 = ParamController2(update=update, csv_file=panel)  # inputs update: Boolean, csv_file: String, section: String
# ---------- prtrl2: Python ----------
"""
Updates Grasshopper parameters from a CSV file, with optional section filtering.

Inputs:
    update: Boolean (item access, bool)
    csv_file: String (item access, str)
    section: String (item access, str) [Optional]

Outputs:
    (None)
"""

try:
    ghenv.Component.Name = "ParamController2"
    ghenv.Component.NickName = "Prtrl2"
    ghenv.Component.Description = "Updates Grasshopper parameters from a CSV file, with optional section filtering."
except NameError:
    pass

import os
import csv
import Grasshopper as gh
import System

def get_gh_doc():
    if 'ghenv' in globals():
        return ghenv.Component.OnPingDocument()
    if 'ghdoc' in globals():
        return ghdoc
    return None

def find_param_by_nickname(doc, nickname):
    matched_params = []
    for obj in doc.Objects:
        if isinstance(obj, gh.Kernel.IGH_Param):
            if obj.NickName == nickname:
                matched_params.append(obj)
    return matched_params

def update_param_value(param, type_str, value_str, doc):
    type_str = type_str.lower().strip()
    value_str = value_str.strip()

    if type_str in ['float', 'num', 'number', 'double']:
        try:
            val = float(value_str)
            param.PersistentData.Clear()
            param.PersistentData.Append(gh.Kernel.Types.GH_Number(val))
            return True
        except ValueError:
            print("Error parsing {} as float".format(value_str))

    elif type_str in ['int', 'integer']:
        try:
            val = int(value_str)
            param.PersistentData.Clear()
            param.PersistentData.Append(gh.Kernel.Types.GH_Integer(val))
            return True
        except ValueError:
            print("Error parsing {} as int".format(value_str))

    elif type_str in ['string', 'str', 'text']:
        param.PersistentData.Clear()
        param.PersistentData.Append(gh.Kernel.Types.GH_String(value_str))
        return True

    elif type_str in ['bool', 'boolean']:
        val = value_str.lower() in ['true', '1', 't', 'yes', 'y']
        param.PersistentData.Clear()
        param.PersistentData.Append(gh.Kernel.Types.GH_Boolean(val))
        return True

    elif type_str in ['crv', 'curve', 'pt', 'point', 'geo', 'geometry', 'brep', 'srf', 'surface']:
        source_params = find_param_by_nickname(doc, value_str)
        if not source_params:
            print("Could not find source parameter with nickname '{}' on canvas".format(value_str))
            return False

        source_param = source_params[0]
        param.RemoveAllSources()
        param.AddSource(source_param)
        return True

    else:
        print("Unsupported type: {}".format(type_str))
        return False

PENDING_UPDATES = []

def schedule_callback(ghdoc):
    global PENDING_UPDATES

    if not PENDING_UPDATES:
        return

    updated_count = 0
    for param, type_str, value_str in PENDING_UPDATES:
        param.RecordUndoEvent("CSV Update")
        if update_param_value(param, type_str, value_str, ghdoc):
            param.ExpireSolution(False)
            updated_count += 1

    PENDING_UPDATES = []

    if updated_count > 0:
        print("Successfully updated {} parameters.".format(updated_count))
        ghdoc.NewSolution(False)

def main():
    global PENDING_UPDATES
    if 'update' not in globals() or not update:
        return

    if 'csv_file' not in globals() or not csv_file or not os.path.exists(csv_file):
        print("Invalid CSV file path or csv_file input not provided")
        return

    active_section = None
    if 'section' in globals() and section:
        active_section = str(section).strip()

    doc = get_gh_doc()
    if not doc:
        print("Could not find Grasshopper document context")
        return

    updated_count = 0

    with open(csv_file, mode='r') as f:
        reader = csv.reader(f)
        try:
            headers = next(reader)
        except StopIteration:
            headers = None

        if not headers:
            print("Empty CSV file")
            return

        header_lower = [h.lower().strip() for h in headers]

        try:
            name_idx = header_lower.index("input name")
            type_idx = header_lower.index("type")
            value_idx = header_lower.index("value")
        except ValueError:
            print("Warning: Could not find exact headers 'input name', 'type', 'value'. Assuming columns 0, 1, 2.")
            name_idx, type_idx, value_idx = 0, 1, 2
            
        try:
            section_idx = header_lower.index("section")
        except ValueError:
            section_idx = 3 if len(headers) > 3 else -1

        PENDING_UPDATES = []
        for row in reader:
            if len(row) <= max(name_idx, type_idx, value_idx):
                continue

            input_name = row[name_idx]
            input_type = row[type_idx]
            input_value = row[value_idx]
            
            row_section = None
            if section_idx != -1 and len(row) > section_idx:
                row_section = row[section_idx].strip()

            if active_section is not None:
                if not row_section or row_section != active_section:
                    continue

            target_params = find_param_by_nickname(doc, input_name)
            if not target_params:
                print("Warning: No parameter found with NickName '{}'".format(input_name))
                continue

            for param in target_params:
                PENDING_UPDATES.append((param, input_type, input_value))
                updated_count += 1

    if updated_count > 0:
        delegate = gh.Kernel.GH_Document.GH_ScheduleDelegate(schedule_callback)
        doc.ScheduleSolution(5, delegate)

if __name__ == "__main__":
    main()
# ---------- end prtrl2 ----------
grid_selection = Number(1)

cell_rad_x = Number(8)
cell_rad_y = Number(8)

eval_domain_a = Number(0.9)
eval_domain_b = Number(0.1)

rand_seed_b = Number(6)
rand_seed_a = Number(3)

attractor_curve = Curve(<curve referenced from the Rhino model>)
scale_a = Number(0.85)
scale_b = Number(0.15)

split_percent = Number(0.3)
cull_percent = Number(0.2)

rectangle = Rectangle(Plane=PlaneXY(0, 0, 0), XSize=bounds_x, YSize=bounds_y, Radius=0)  # -> Rectangle, Length
crv = Curve(rectangle.Rectangle)
brec = BoundingRectangle(Geometry=crv, Plane=PlaneXY(0, 0, 0), Axis=0, Slide=0, Union=True)  # -> Bounding, DimensionX, DimensionY
Y = UnitY(Factor=brec.DimensionY)
arrlinear = LinearArray(Geometry=crv, Direction=Y, Count=level_count)  # -> Geometry, Transform

brec_2 = BoundingRectangle(Geometry=arrlinear.Geometry, Plane=PlaneXY(0, 0, 0), Axis=0, Slide=0, Union=True)  # -> Bounding, DimensionX, DimensionY

offset = OffsetCurve(Curve=brec_2.Bounding, Distance=bound_offset, Corners=1)

bpanel = BoundPanel(boundary=brec_2.Bounding, size_x=panel_x, size_y=panel_y)  # -> panels; inputs boundary: Curve, size_x: Double, size_y: Double, use_world_xy: Boolean
# ---------- bpanel: Python ----------
"""
Creates a grid of rectangular panels that perfectly fit within a bounding curve.

Inputs:
    boundary: Geometry (item access, crv)
    size_x: Number (item access, float)
    size_y: Number (item access, float)
    use_world_xy: Boolean (item access, bool)

Outputs:
    panels: List of Curves (The rectangular panels)
"""

try:
    ghenv.Component.Name = "BoundPanel"
    ghenv.Component.NickName = "BPanel"
    ghenv.Component.Description = "Creates a grid of rectangular panels that perfectly fit within a bounding curve."
except NameError:
    pass

import Rhino
import scriptcontext as sc
from Rhino.Geometry import Plane, Rectangle3d, Interval

def _doc_tol():
    if sc.doc:
        return sc.doc.ModelAbsoluteTolerance
    if Rhino.RhinoDoc.ActiveDoc:
        return Rhino.RhinoDoc.ActiveDoc.ModelAbsoluteTolerance
    return 1e-3

def sizes_1d(L, S, tol):
    if S <= tol:
        return [L]

    n_full = int(L // S)
    rem = L - (n_full * S)

    if abs(rem) <= tol:
        return [S] * n_full

    cap = 0.5 * rem

    if cap <= tol:
        return [S] * n_full

    return [cap] + ([S] * n_full) + [cap]

panels = []

if 'boundary' in globals() and boundary is not None:
    tol = _doc_tol()

    if 'use_world_xy' in globals() and use_world_xy:
        pl = Plane.WorldXY
    else:
        ok, pl = boundary.TryGetPlane(tol)
        if not ok:
            pl = Plane.WorldXY

    bb = boundary.GetBoundingBox(pl)

    Lx = bb.Max.X - bb.Min.X
    Ly = bb.Max.Y - bb.Min.Y

    x_sizes = sizes_1d(Lx, float(size_x), tol)
    y_sizes = sizes_1d(Ly, float(size_y), tol)

    x0 = bb.Min.X
    for sx in x_sizes:
        y0 = bb.Min.Y
        for sy in y_sizes:
            rect = Rectangle3d(
                pl,
                Interval(x0, x0 + sx),
                Interval(y0, y0 + sy)
            )
            panels.append(rect.ToNurbsCurve())
            y0 += sy
        x0 += sx
# ---------- end bpanel ----------
neg = Negative(Value=pattern_offset)
neg_2 = Negative(Value=panel_offset)
offset_2 = OffsetCurve(Curve=bpanel, Distance=neg, Corners=1)
offset_3 = OffsetCurve(Curve=bpanel, Distance=neg_2, Corners=1)
crv_2 = Curve(offset_2)
crv_3 = Curve(flatten(offset_3))

neg_3 = Negative(Value=facade_offset)
crv_4 = Curve(arrlinear.Geometry)
offset_4 = OffsetCurve(Curve=crv_4, Distance=neg_3, Corners=1)
crv_5 = Curve(offset_4)
division = Division(A=neg_3, B=2)
offset_5 = OffsetCurve(Curve=bpanel, Distance=division, Corners=1)  # -> flatten(Curve)
rint = RegionIntersection(CurvesA=offset_5, CurvesB=crv_5)
brec_3 = BoundingRectangle(Geometry=graft(rint), Plane=PlaneXY(0, 0, 0), Axis=0, Slide=0, Union=True)  # -> Bounding, DimensionX, DimensionY
crv_6 = Curve(crv_4)
crv_7 = Curve(flatten(brec_3.Bounding))

crv_8 = Curve(flatten([crv_6, crv_7]))

crv_9 = Curve(brec_3.Bounding)
bpanel_2 = BoundPanel(boundary=graft(crv_9), size_x=window_x, size_y=window_y)  # -> panels; inputs boundary: Curve, size_x: Double, size_y: Double, use_world_xy: Boolean; same code as bpanel
crv_10 = Curve(bpanel_2)
neg_4 = Negative(Value=mullion_offset)
offset_6 = OffsetCurve(Curve=crv_9, Distance=neg_4, Corners=1)
crv_11 = Curve(offset_6)
division_2 = Division(A=neg_4, B=2)
offset_7 = OffsetCurve(Curve=crv_10, Distance=division_2, Corners=1)  # -> flatten(Curve)
rint_2 = RegionIntersection(CurvesA=offset_7, CurvesB=crv_11)
crv_12 = Curve(flatten(rint_2))
crv_13 = Curve(rint_2)
merge = Merge(Data1=crv_9, Data2=crv_13)  # -> flatten(Result)

# ---- group: STAGE 1 - GRID SYSTEM
expression = Expression(x=cell_rad_y, Expression="(sqrt(3)/2)*x")
brg = BoundRectGrid(boundary=offset, size_x=cell_rad_x, size_y=cell_rad_y)  # -> rectgrid, bnd_rect; inputs boundary: Curve, size_x: Double, size_y: Double
# ---------- brg: Python ----------
"""
Creates a grid of individual closed rectangular cells within a region.

Inputs:
    boundary: Geometry (item access, crv)
    size_x: Number (item access, float)
    size_y: Number (item access, float)

Outputs:
    rectgrid: List of Curves (The final individual closed rectangular cells)
    bnd_rect: Curve (The bounding rectangle of the original input)
"""

try:
    ghenv.Component.Name = "BoundRectGrid"
    ghenv.Component.NickName = "BRG"
    ghenv.Component.Description = "Creates a grid of individual closed rectangular cells within a region."
except NameError:
    pass

import Rhino.Geometry as rg

def create_closed_rect_cells(region_geometry, size_x_val, size_y_val):
    if region_geometry is None: return [], None
    if size_x_val <= 0 or size_y_val <= 0: return [], None

    bbox = region_geometry.GetBoundingBox(rg.Plane.WorldXY)
    if not bbox.IsValid: return [], None

    p_min = bbox.Min
    p_max = bbox.Max

    pt_bl = rg.Point3d(p_min.X, p_min.Y, 0)
    pt_br = rg.Point3d(p_max.X, p_min.Y, 0)
    pt_tr = rg.Point3d(p_max.X, p_max.Y, 0)
    pt_tl = rg.Point3d(p_min.X, p_max.Y, 0)

    bnd_rect_curve = rg.PolylineCurve(rg.Polyline([pt_bl, pt_br, pt_tr, pt_tl, pt_bl]))

    width = p_max.X - p_min.X
    height = p_max.Y - p_min.Y

    if width <= 0 or height <= 0: return [], bnd_rect_curve

    cells_x = max(1, int(round(width / size_x_val)))
    cells_y = max(1, int(round(height / size_y_val)))

    actual_dx = width / float(cells_x)
    actual_dy = height / float(cells_y)

    final_rects = []
    tol = 1e-5

    for row in range(-2, cells_y + 4):
        cy = p_min.Y + (actual_dy / 2.0) + (row * actual_dy)

        for col in range(-2, cells_x + 4):
            cx = p_min.X + (actual_dx / 2.0) + (col * actual_dx)

            if (cx - actual_dx/2.0 >= p_min.X - tol and
                cx + actual_dx/2.0 <= p_max.X + tol and
                cy - actual_dy/2.0 >= p_min.Y - tol and
                cy + actual_dy/2.0 <= p_max.Y + tol):

                pt0 = rg.Point3d(cx - actual_dx/2.0, cy - actual_dy/2.0, 0)
                pt1 = rg.Point3d(cx + actual_dx/2.0, cy - actual_dy/2.0, 0)
                pt2 = rg.Point3d(cx + actual_dx/2.0, cy + actual_dy/2.0, 0)
                pt3 = rg.Point3d(cx - actual_dx/2.0, cy + actual_dy/2.0, 0)

                pline = rg.Polyline([pt0, pt1, pt2, pt3, pt0])
                final_rects.append(rg.PolylineCurve(pline))

    return final_rects, bnd_rect_curve

if 'boundary' in globals() and 'size_x' in globals() and 'size_y' in globals():
    rectgrid, bnd_rect = create_closed_rect_cells(boundary, size_x, size_y)
# ---------- end brg ----------
bhg = BoundHexGrid(boundary=offset, size_x=expression, size_y=cell_rad_y)  # -> hexgrid, bnd_rect; inputs boundary: Curve, size_x: Double, size_y: Double
# ---------- bhg: Python ----------
"""
Creates a grid of individual closed hexagonal cells within a region.

Inputs:
    boundary: Geometry (item access, crv)
    size_x: Number (item access, float)
    size_y: Number (item access, float)

Outputs:
    hexgrid: List of Curves (The final individual closed hexagonal cells)
    bnd_rect: Curve (The bounding rectangle of the original input)
"""

try:
    ghenv.Component.Name = "BoundHexGrid"
    ghenv.Component.NickName = "BHG"
    ghenv.Component.Description = "Creates a grid of individual closed hexagonal cells within a region."
except NameError:
    pass

import Rhino.Geometry as rg
import math

def create_closed_hex_cells(region_geometry, size_x_val, size_y_val):
    if region_geometry is None: return [], None
    if size_x_val <= 0 or size_y_val <= 0: return [], None

    bbox = region_geometry.GetBoundingBox(rg.Plane.WorldXY)
    if not bbox.IsValid: return [], None

    p_min = bbox.Min
    p_max = bbox.Max

    pt_bl = rg.Point3d(p_min.X, p_min.Y, 0)
    pt_br = rg.Point3d(p_max.X, p_min.Y, 0)
    pt_tr = rg.Point3d(p_max.X, p_max.Y, 0)
    pt_tl = rg.Point3d(p_min.X, p_max.Y, 0)

    bnd_rect_curve = rg.PolylineCurve(rg.Polyline([pt_bl, pt_br, pt_tr, pt_tl, pt_bl]))

    width = p_max.X - p_min.X
    height = p_max.Y - p_min.Y

    if width <= 0 or height <= 0: return [], bnd_rect_curve

    cells_x = max(1, int(round(width / size_x_val)))
    cells_y = max(1, int(round(height / (size_y_val * 0.75))))

    actual_dx = width / float(cells_x)
    actual_dy = height / float(cells_y)

    rx = actual_dx / math.sqrt(3.0)
    ry = actual_dy / 1.5

    final_hexes = []
    tol = 1e-5

    for row in range(-2, cells_y + 4):
        cy = p_min.Y + (actual_dy / 2.0) + (row * actual_dy)

        if row % 2 == 0:
            cx_start = p_min.X + (actual_dx / 2.0)
        else:
            cx_start = p_min.X + actual_dx

        for col in range(-2, cells_x + 4):
            cx = cx_start + col * actual_dx

            if (cx - actual_dx/2.0 >= p_min.X - tol and
                cx + actual_dx/2.0 <= p_max.X + tol and
                cy - actual_dy/2.0 >= p_min.Y - tol and
                cy + actual_dy/2.0 <= p_max.Y + tol):

                pts = []
                for k in range(6):
                    ang = math.radians(30.0 + 60.0 * k)
                    vx = cx + rx * math.cos(ang)
                    vy = cy + ry * math.sin(ang)
                    pts.append(rg.Point3d(vx, vy, 0.0))
                pts.append(pts[0])

                pline = rg.Polyline(pts)
                final_hexes.append(rg.PolylineCurve(pline))

    return final_hexes, bnd_rect_curve

if 'boundary' in globals() and 'size_x' in globals() and 'size_y' in globals():
    hexgrid, bnd_rect = create_closed_hex_cells(boundary, size_x, size_y)
# ---------- end bhg ----------
bdg = BoundDiaGrid(boundary=offset, size_x=cell_rad_x, size_y=cell_rad_y)  # -> diagrid, bnd_rect; inputs boundary: Curve, size_x: Double, size_y: Double
# ---------- bdg: Python ----------
"""
Creates a grid of individual closed diamond cells within a region.

Inputs:
    boundary: Geometry (item access, crv)
    size_x: Number (item access, float)
    size_y: Number (item access, float)

Outputs:
    diagrid: List of Curves (The final individual closed diamond cells)
    bnd_rect: Curve (The bounding rectangle of the original input)
"""

try:
    ghenv.Component.Name = "BoundDiaGrid"
    ghenv.Component.NickName = "BDG"
    ghenv.Component.Description = "Creates a grid of individual closed diamond cells within a region."
except NameError:
    pass

import Rhino.Geometry as rg

def create_closed_diamond_cells(region_geometry, size_x_val, size_y_val):
    if region_geometry is None: return [], None
    if size_x_val <= 0 or size_y_val <= 0: return [], None
    
    bbox = region_geometry.GetBoundingBox(rg.Plane.WorldXY)
    if not bbox.IsValid: return [], None

    p_min = bbox.Min
    p_max = bbox.Max
    
    pt_bl = rg.Point3d(p_min.X, p_min.Y, 0)
    pt_br = rg.Point3d(p_max.X, p_min.Y, 0)
    pt_tr = rg.Point3d(p_max.X, p_max.Y, 0)
    pt_tl = rg.Point3d(p_min.X, p_max.Y, 0)
    
    bnd_rect_curve = rg.PolylineCurve(rg.Polyline([pt_bl, pt_br, pt_tr, pt_tl, pt_bl]))
    
    width = p_max.X - p_min.X
    height = p_max.Y - p_min.Y
    
    if width <= 0 or height <= 0: return [], bnd_rect_curve

    cells_x = max(1, int(round(width / size_x_val)))
    cells_y = max(1, int(round(height / size_y_val)))
    
    actual_dx = width / float(cells_x)
    actual_dy = height / float(cells_y)

    final_diamonds = []
    tol = 1e-5 

    for row in range(-2, (cells_y * 2) + 4):
        cy = p_min.Y + (actual_dy / 2.0) + (row * (actual_dy / 2.0))
        
        if row % 2 == 0:
            cx_start = p_min.X + (actual_dx / 2.0)
        else:
            cx_start = p_min.X + actual_dx
            
        for col in range(-2, cells_x + 4):
            cx = cx_start + col * actual_dx
            
            if (cx - actual_dx/2.0 >= p_min.X - tol and 
                cx + actual_dx/2.0 <= p_max.X + tol and 
                cy - actual_dy/2.0 >= p_min.Y - tol and 
                cy + actual_dy/2.0 <= p_max.Y + tol):
                
                pt0 = rg.Point3d(cx - actual_dx/2.0, cy, 0)
                pt1 = rg.Point3d(cx, cy - actual_dy/2.0, 0)
                pt2 = rg.Point3d(cx + actual_dx/2.0, cy, 0)
                pt3 = rg.Point3d(cx, cy + actual_dy/2.0, 0)
                pt4 = rg.Point3d(cx - actual_dx/2.0, cy, 0)
                
                pline = rg.Polyline([pt0, pt1, pt2, pt3, pt4])
                final_diamonds.append(rg.PolylineCurve(pline))

    return final_diamonds, bnd_rect_curve

if 'boundary' in globals() and 'size_x' in globals() and 'size_y' in globals():
    diagrid, bnd_rect = create_closed_diamond_cells(boundary, size_x, size_y)
# ---------- end bdg ----------
crv_14 = Curve(bdg.diagrid)
crv_15 = Curve(brg.rectgrid)
crv_16 = Curve(bhg.hexgrid)
filter = StreamFilter(Gate=grid_selection, Stream0=crv_15, Stream1=crv_16, Stream2=crv_14)
crv_17 = Curve(filter)

# ---- group: STAGE 2 - PATTERN CREATION
dom = ConstructDomain(DomainStart=eval_domain_a, DomainEnd=eval_domain_b)
lng = ListLength(List=crv_17)
random = Random(Range=dom, Number=lng, Seed=rand_seed_a)
random_2 = Random(Range=dom, Number=lng, Seed=rand_seed_b)
pt = ConstructPoint(XCoordinate=random, YCoordinate=random_2, ZCoordinate=0)
evalsrf = EvaluateSurface(Surface=reparameterize(graft(crv_17)), Point=graft(pt))  # -> flatten(Point), Normal, UDirection, VDirection, Frame
pt_2 = Point(evalsrf.Point)

incurve = PointInCurve(Point=pt_2, Curve=crv_2)  # -> Relationship, Point
larger = LargerThan(FirstNumber=incurve.Relationship, SecondNumber=1)  # -> LargerThan, OrEqualTo
cull = CullPattern(List=pt_2, CullPattern=larger.LargerThan)
voronoi = Voronoi(Points=cull, Boundary=crv_2, BruteForceOverride=False)

# ---- group: STAGE 3 - ATTRACTORS
crv_18 = Curve(flatten(voronoi))
area = Area(Geometry=crv_18)  # -> Area, Centroid
curve_attractor = CurveAttractor(C=attractor_curve, P=area.Centroid, A=scale_a, B=scale_b)  # -> R, points_on_curve_2
scale = Scale(Geometry=crv_18, Center=area.Centroid, Factor=curve_attractor.R)  # -> Geometry, Transform
crv_19 = Curve(scale.Geometry)

# ---- group: STAGE 4 - CULL
area_2 = Area(Geometry=crv_19)  # -> Area, Centroid
bnd = Bounds(Numbers=area_2.Area)
dom_2 = ConstructDomain(DomainStart=0, DomainEnd=1)
remap = RemapNumbers(Value=area_2.Area, Source=bnd, Target=dom_2)  # -> Mapped, Clipped
expression_2 = Expression(x=remap.Mapped, y=split_percent, Expression="x>y")
cull_2 = CullPattern(List=crv_19, CullPattern=invert(expression_2))
cull_3 = CullPattern(List=crv_19, CullPattern=expression_2)
lng_2 = ListLength(List=cull_2)
multiplication = Multiplication(A=lng_2, B=cull_percent)
reduce = RandomReduce(List=cull_2, Reduction=multiplication, Seed=1)
merge_2 = Merge(Data1=cull_3, Data2=reduce)  # -> flatten(Result)

# ---- group: STAGE 5 - FACTS
panels = Curve(flatten(offset_3))
area_3 = Area(Geometry=merge_2)  # -> Area, Centroid
brec_4 = BoundingRectangle(Geometry=graft(merge_2), Plane=PlaneXY(0, 0, 0), Axis=0, Slide=0, Union=True)  # -> Bounding, DimensionX, DimensionY
area_4 = Area(Geometry=panels)  # -> Area, Centroid
ma = MassAddition(Input=area_3.Area)  # -> Result, PartialResults
ma_2 = MassAddition(Input=area_4.Area)  # -> Result, PartialResults
merge_3 = Merge(Data1=brec_4.DimensionX, Data2=brec_4.DimensionY)  # -> flatten(Result)
division_3 = Division(A=ma.Result, B=ma_2.Result)
bnd_2 = Bounds(Numbers=merge_3)

# ----
facade = Curve(crv_8)
mullions = Curve(merge)
glaze = Curve(crv_12)

panels_2 = Curve(crv_3)
pattern = Curve(crv_19)
pattern_culled = Curve(merge_2)

aperture_diam_range = Panel(bnd_2)
percent_porosity = Panel(division_3)

# ==== cluster CurveAttractor: Utility
C = ClusterInput()
P = ClusterInput()
x = ClusterInput()
A = ClusterInput()
B = ClusterInput()
crv_cp = CurveClosestPoint(Point=P, Curve=C)  # -> Point, Parameter, Distance
dom = ConstructDomain(DomainStart=A, DomainEnd=B)
bnd = Bounds(Numbers=crv_cp.Distance)
remap = RemapNumbers(Value=crv_cp.Distance, Source=bnd, Target=dom)  # -> Mapped, Clipped
R = ClusterOutput(remap.Mapped)
points_on_curve = Point(crv_cp.Point)
points_on_curve_2 = ClusterOutput(points_on_curve)
