# Grasshopper definition parametric-sandbox-v0.2.gh (Grasshopper 1.0.8)
# plug-ins: Pufferfish

xz = XZPlane(Origin=Point(0, 0, 0))
number_slider = Slider(300, range=0..1000)  # disabled
rectangle = Rectangle(Plane=xz, XSize=Slider(240, range=0..1000), YSize=Slider(180, range=0..1000), Radius=0)  # -> Rectangle, Length

number_slider_2 = Slider(240, range=0..1000)  # disabled
number_slider_3 = Slider(240, range=0..1000)  # disabled
pt = Point(Point(0, 0, 0))  # disabled

subtraction = Subtraction(A=number_slider, B=number_slider_2)  # disabled
crv = Curve(rectangle.Rectangle)
neg = Negative(Value=subtraction)  # disabled
rectangle_2 = Rectangle(Plane=PlaneXY(0, 0, 0), XSize=Slider(240, range=0..1000), YSize=Slider(180, range=0..1000), Radius=0)  # -> Rectangle, Length
X = UnitX(Factor=neg)  # disabled
boundary_panel = BoundaryPanel(Bnd=rectangle_2.Rectangle, SheetX=Slider(120, range=0..1000), SheetY=Slider(60, range=0..1000))  # -> Panels; inputs Bnd: Curve, SheetX: Double, SheetY: Double, UseWorldXY: Boolean
# ---------- boundary_panel: Python ----------
import Rhino
import scriptcontext as sc
from Rhino.Geometry import Plane, Rectangle3d, Interval

# Inputs:
#   Bnd        : Curve
#   SheetX     : float
#   SheetY     : float
#   UseWorldXY : bool
#
# Output:
#   Panels     : list[Curve]


def _doc_tol():
    if sc.doc:
        return sc.doc.ModelAbsoluteTolerance
    if Rhino.RhinoDoc.ActiveDoc:
        return Rhino.RhinoDoc.ActiveDoc.ModelAbsoluteTolerance
    return 1e-3


def sizes_1d(L, S, tol):
    """
    Fills length L with:
    - as many full sheets S as possible
    - remainder split equally into two end caps
    - full sheets centered between caps
    """
    if S <= tol:
        return [L]

    n_full = int(L // S)
    rem = L - (n_full * S)

    if abs(rem) <= tol:
        return [S] * n_full

    cap = 0.5 * rem

    if cap <= tol:
        return [S] * n_full

    return [cap] + ([S] * n_full) + [cap]


Panels = []

if Bnd is None:
    Panels = []
else:
    tol = _doc_tol()

    # Choose working plane
    if UseWorldXY:
        pl = Plane.WorldXY
    else:
        ok, pl = Bnd.TryGetPlane(tol)
        if not ok:
            pl = Plane.WorldXY

    # Bounding box in chosen plane
    bb = Bnd.GetBoundingBox(pl)

    Lx = bb.Max.X - bb.Min.X
    Ly = bb.Max.Y - bb.Min.Y

    x_sizes = sizes_1d(Lx, float(SheetX), tol)
    y_sizes = sizes_1d(Ly, float(SheetY), tol)

    x0 = bb.Min.X
    for sx in x_sizes:
        y0 = bb.Min.Y
        for sy in y_sizes:
            rect = Rectangle3d(
                pl,
                Interval(x0, x0 + sx),
                Interval(y0, y0 + sy)
            )
            Panels.append(rect.ToNurbsCurve())
            y0 += sy
        x0 += sx
# ---------- end boundary_panel ----------
grid_in_region = GridInRegion(B=rectangle_2.Rectangle, RadX=Slider(4, range=0..100), Type=Slider(2, range=0..10))  # -> GridCells, R, C; inputs B: Curve, RadX: Double, RadY: Double, Type: Boolean
# ---------- grid_in_region: Python ----------
import math
import Rhino
from Rhino.Geometry import Point3d, Polyline, PolylineCurve
from Rhino.Geometry.Intersect import Intersection
from Grasshopper import DataTree
from Grasshopper.Kernel.Data import GH_Path

def _is_closed_planar(crv, tol):
    if crv is None: return False
    if not crv.IsClosed: return False
    ok, _ = crv.TryGetPlane(tol)
    return ok

def _curve_plane(crv, tol):
    ok, pln = crv.TryGetPlane(tol)
    return pln if ok else None

def _hex_pts_xy(cx, cy, rx, ry):
    # pointy-top hex; rx stretches X, ry stretches Y
    pts = []
    for k in range(6):
        ang = math.radians(30.0 + 60.0 * k)
        pts.append((cx + rx * math.cos(ang), cy + ry * math.sin(ang)))
    return pts

def _rect_pts_xy(cx, cy, rx, ry):
    # axis-aligned rectangle; if rx==ry it's a square
    return [
        (cx - rx, cy - ry),
        (cx + rx, cy - ry),
        (cx + rx, cy + ry),
        (cx - rx, cy + ry),
    ]

def _poly_fully_inside(cell_crv, boundary, plane, tol):
    ok, pl = cell_crv.TryGetPolyline()
    if not ok:
        return False

    # all vertices must be inside (or on boundary)
    for i in range(pl.Count - 1):
        if boundary.Contains(pl[i], plane, tol) == Rhino.Geometry.PointContainment.Outside:
            return False

    # any intersection (including touching) rejects
    x = Intersection.CurveCurve(cell_crv, boundary, tol, tol)
    if x and x.Count > 0:
        return False

    return True

# ----------------------------
# Main
# ----------------------------
GridCells = []
R = DataTree[object]()  # rows
C = DataTree[object]()  # cols

if B is None or RadX is None:
    GridCells = []
else:
    tol = Rhino.RhinoDoc.ActiveDoc.ModelAbsoluteTolerance if Rhino.RhinoDoc.ActiveDoc else 1e-6

    rx = float(RadX)
    if rx <= 0.0:
        GridCells = []
    else:
        # Critical rule: if RadY == 0 -> regular polygons
        if RadY is None:
            ry = rx
        else:
            ry_in = float(RadY)
            ry = rx if abs(ry_in) <= tol else ry_in

        if not _is_closed_planar(B, tol):
            GridCells = []
        else:
            plane = _curve_plane(B, tol)

            # boundary plane coords -> World XY
            xform_w2p = Rhino.Geometry.Transform.ChangeBasis(plane, Rhino.Geometry.Plane.WorldXY)
            xform_p2w = Rhino.Geometry.Transform.ChangeBasis(Rhino.Geometry.Plane.WorldXY, plane)

            B2 = B.DuplicateCurve()
            B2.Transform(xform_w2p)

            mp = Rhino.Geometry.AreaMassProperties.Compute(B2)
            ctr2 = mp.Centroid if mp else B2.GetBoundingBox(True).Center

            use_hex = True if Type else False

            # Grid spacing derived from rx/ry
            if use_hex:
                dx = math.sqrt(3.0) * rx
                dy = 1.5 * ry
            else:
                dx = 2.0 * rx
                dy = 2.0 * ry

            bb = B2.GetBoundingBox(True)
            minx = bb.Min.X - 2.0 * dx
            maxx = bb.Max.X + 2.0 * dx
            miny = bb.Min.Y - 2.0 * dy
            maxy = bb.Max.Y + 2.0 * dy

            j_min = int(math.floor((miny - ctr2.Y) / dy)) - 1
            j_max = int(math.ceil((maxy - ctr2.Y) / dy)) + 1
            i_min = int(math.floor((minx - ctr2.X) / dx)) - 1
            i_max = int(math.ceil((maxx - ctr2.X) / dx)) + 1

            cells_by_row = {}  # j -> list of (i, curve)
            cells_by_col = {}  # i -> list of (j, curve)

            for j in range(j_min, j_max + 1):
                y = ctr2.Y + j * dy
                row_offset = (0.5 * dx if (use_hex and (j & 1)) else 0.0)

                for i in range(i_min, i_max + 1):
                    x = ctr2.X + i * dx + row_offset
                    cpt2 = Point3d(x, y, 0.0)

                    # quick cull: center must be inside
                    if B2.Contains(cpt2, Rhino.Geometry.Plane.WorldXY, tol) == Rhino.Geometry.PointContainment.Outside:
                        continue

                    # build candidate cell in plane coords (WorldXY)
                    if use_hex:
                        verts = _hex_pts_xy(x, y, rx, ry)
                    else:
                        verts = _rect_pts_xy(x, y, rx, ry)

                    pts = [Point3d(vx, vy, 0.0) for (vx, vy) in verts]
                    pts.append(pts[0])

                    pline = Polyline(pts)
                    if not pline.IsValid:
                        continue

                    cell2 = PolylineCurve(pline)

                    if not _poly_fully_inside(cell2, B2, Rhino.Geometry.Plane.WorldXY, tol):
                        continue

                    cell_w = cell2.DuplicateCurve()
                    cell_w.Transform(xform_p2w)

                    GridCells.append(cell_w)
                    cells_by_row.setdefault(j, []).append((i, cell_w))
                    cells_by_col.setdefault(i, []).append((j, cell_w))

            # Rows -> R (branches ordered by j, items ordered by i)
            row_keys = sorted(cells_by_row.keys())
            for r_idx, j in enumerate(row_keys):
                path = GH_Path(r_idx)
                for (_, crv) in sorted(cells_by_row[j], key=lambda t: t[0]):
                    R.Add(crv, path)

            # Cols -> C (branches ordered by i, items ordered by j)
            col_keys = sorted(cells_by_col.keys())
            for c_idx, i in enumerate(col_keys):
                path = GH_Path(c_idx)
                for (_, crv) in sorted(cells_by_col[i], key=lambda t: t[0]):
                    C.Add(crv, path)
# ---------- end grid_in_region ----------
rectangle_3 = Rectangle(Plane=pt, XSize=number_slider_2, YSize=number_slider_3, Radius=0)  # -> Rectangle, Length; disabled
neg_2 = Negative(Value=Slider(2, range=0..10))

number_slider_4 = Slider(60, range=0..1000)  # disabled
number_slider_5 = Slider(1, range=0..10)  # disabled

number_slider_6 = Slider(1.5, range=0..10)

number_slider_7 = Slider(180, range=0..1000)  # disabled
number_slider_8 = Slider(12, range=0..1000)  # disabled
number_slider_9 = Slider(3, range=0..10)  # disabled

Z = UnitZ(Factor=number_slider_7)  # disabled
move = Move(Geometry=pt, Motion=Z)  # -> Geometry, Transform; disabled
rectangle_4 = Rectangle(Plane=move.Geometry, XSize=number_slider, YSize=number_slider_3, Radius=0)  # -> Rectangle, Length; disabled
move_2 = Move(Geometry=rectangle_4.Rectangle, Motion=X)  # -> Geometry, Transform; disabled

number_slider_10 = Slider(6, range=0..10)  # disabled
number_slider_11 = Slider(4, range=0..10)  # disabled

srf = Surface(crv)
crv_2 = Curve(rectangle_3.Rectangle)  # disabled
Y = UnitY(Factor=Slider(360, range=0..1000))
disc = Discontinuity(Curve=crv_2, Level=1)  # -> Points, Parameters; disabled
neg_3 = Negative(Value=Slider(8, range=0..10))
neg_4 = Negative(Value=number_slider_6)
offset = OffsetCurve(Curve=crv, Distance=neg_2, Corners=1)
neg_5 = Negative(Value=Slider(12, range=0..100))
boundary_panel_2 = BoundaryPanel(Bnd=crv, SheetX=Slider(80, range=0..1000), SheetY=Slider(90, range=0..1000))  # -> Panels; inputs Bnd: Curve, SheetX: Double, SheetY: Double, UseWorldXY: Boolean; same code as boundary_panel
disc_2 = Discontinuity(Curve=crv_2, Level=1)  # -> Points, Parameters; disabled
extr = Extrude(Base=srf, Direction=Y)
item = ListItem(List=disc.Points, Index=0, Wrap=True)  # disabled
srf_2 = Surface(crv_2)  # disabled
offset_2 = OffsetCurve(Curve=boundary_panel, Distance=neg_4, Corners=1)
offset_3 = OffsetCurve(Curve=crv, Distance=neg_3, Corners=1)
offset_4 = OffsetCurve(Curve=crv, Distance=neg_5, Corners=1)
Z_2 = UnitZ(Factor=number_slider_8)  # disabled
crv_3 = Curve(offset)
crv_4 = Curve(boundary_panel_2)
neg_6 = Negative(Value=number_slider_10)  # disabled
crv_5 = Curve(graft(boundary_panel))
crv_6 = Curve(boundary_panel_2)
multiplication = Multiplication(A=number_slider_11, B=2)  # disabled
crv_7 = Curve(offset_2)
crv_8 = Curve(offset_4)
neg_7 = Negative(Value=Slider(2, range=0..10))
neg_8 = Negative(Value=multiplication)  # disabled
dom = ConstructDomain(DomainStart=number_slider_10, DomainEnd=neg_6)  # disabled
srfsplit = SurfaceSplit(Surface=crv_3, Curves=crv_4)
dom_2 = ConstructDomain(DomainStart=multiplication, DomainEnd=neg_8)  # disabled
neg_9 = Negative(Value=Slider(0.5, range=0..10))
crv_9 = Curve(offset_3)
boundary = BoundarySurfaces(Edges=[crv_5, crv_7])
offset_5 = OffsetCurve(Curve=crv_8, Distance=neg_7, Corners=1)
move_3 = Move(Geometry=crv_2, Motion=Z_2)  # -> Geometry, Transform; disabled
rectangle_5 = Rectangle(Plane=PlaneXY(0, 0, 0), XSize=Domain(-1, 1), YSize=Domain(-2, 2), Radius=0)  # -> Rectangle, Length; disabled
neg_10 = Negative(Value=number_slider_9)  # disabled
subtraction_2 = Subtraction(A=number_slider_7, B=number_slider_8)  # disabled
crv_10 = Curve(srfsplit)
rectangle_6 = Rectangle(Plane=disc_2.Points, XSize=dom_2, YSize=dom, Radius=0)  # -> Rectangle, Length; disabled
Z_3 = UnitZ(Factor=number_slider_6)
neg_11 = Negative(Value=Slider(4, range=0..10))
offset_6 = OffsetCurve(Curve=move_3.Geometry, Distance=neg_10, Corners=1)  # disabled
offset_7 = OffsetCurve(Curve=crv_10, Distance=neg_9, Corners=1)
neg_12 = Negative(Value=Z_3)
Z_4 = UnitZ(Factor=number_slider_7)  # disabled
srf_3 = Surface(crv_9)
srf_4 = Surface(rectangle_6.Rectangle)  # disabled
Y_2 = UnitY(Factor=neg_11)
extr_2 = Extrude(Base=boundary, Direction=neg_12)
srf_5 = Surface(offset_6)  # disabled
brec = BoundingRectangle(Geometry=srf_5, Plane=PlaneXY(0, 0, 0), Axis=0, Slide=0, Union=True)  # -> Bounding, DimensionX, DimensionY; disabled
Z_5 = UnitZ(Factor=subtraction_2)  # disabled
srfsplit_2 = SurfaceSplit(Surface=offset_5, Curves=crv_6)
extr_3 = Extrude(Base=srf_3, Direction=Y_2)
division = Division(A=brec.DimensionX, B=number_slider_4)  # disabled
crv_11 = Curve(srfsplit_2)
neg_13 = Negative(Value=Slider(6.0625, range=0..10))
neg_14 = Negative(Value=Slider(1, range=0..1))
sdivide = DivideSurface(Surface=srf_5, UCount=1, VCount=division)  # -> Points, Normals, Parameters; disabled
neg_15 = Negative(Value=number_slider_5)  # disabled
flip = FlipMatrix(Data=sdivide.Points)  # disabled
Y_3 = UnitY(Factor=neg_13)
offset_8 = OffsetCurve(Curve=crv_11, Distance=neg_14, Corners=1)  # -> flatten(Curve)
dom_3 = ConstructDomain(DomainStart=number_slider_5, DomainEnd=neg_15)  # disabled
item_2 = ListItem(List=flip, Index=0, Wrap=True)  # disabled
move_4 = Move(Geometry=offset_7, Motion=Y_3)  # -> Geometry, Transform
rectangle_7 = Rectangle(Plane=flatten(item_2), XSize=dom_3, YSize=dom_3, Radius=0)  # -> Rectangle, Length; disabled
crv_12 = Curve(offset_8)
srf_6 = Surface(rectangle_7.Rectangle)  # disabled
crv_13 = Curve(move_4.Geometry)
extr_4 = Extrude(Base=srf_2, Direction=Z_2)  # disabled
extr_5 = Extrude(Base=srf_5, Direction=Z_5)  # disabled
extr_6 = Extrude(Base=srf_4, Direction=Z_4)  # disabled
extr_7 = Extrude(Base=srf_6, Direction=Z_5)  # disabled
crv_14 = Curve(flatten([crv_8, crv_12]))
geo = Geometry(extr_4)  # disabled
geo_2 = Geometry(extr_5)  # disabled
geo_3 = Geometry(extr_6)  # disabled
geo_4 = Geometry(extr_7)  # disabled
Y_4 = UnitY(Factor=number_slider_3)  # disabled
neg_16 = Negative(Value=Slider(6, range=0..10))
boundary_2 = BoundarySurfaces(Edges=crv_14)
Y_5 = UnitY(Factor=neg_16)
srf_7 = Surface(crv_13)
extr_8 = Extrude(Base=boundary_2, Direction=Y_5)
xz_2 = XZPlane(Origin=Point(0, 0, 0))
number_slider_12 = Slider(5, range=0..10)  # disabled
brec_2 = BoundingRectangle(Geometry=crv_13, Plane=xz_2, Axis=0, Slide=0, Union=True)  # -> simplify(Bounding), simplify(DimensionX), simplify(DimensionY)
number_slider_13 = Slider(3, range=0..100)
number_slider_14 = Slider(5, range=0..100)
arrlinear = LinearArray(Geometry=geo, Direction=Y_4, Count=number_slider_12)  # -> Geometry, Transform; disabled
arrlinear_2 = LinearArray(Geometry=geo_2, Direction=Y_4, Count=number_slider_12)  # -> Geometry, Transform; disabled
arrlinear_3 = LinearArray(Geometry=geo_3, Direction=Y_4, Count=number_slider_12)  # -> flatten(Geometry), Transform; disabled
arrlinear_4 = LinearArray(Geometry=geo_4, Direction=Y_4, Count=number_slider_12)  # -> flatten(Geometry), Transform; disabled
disc_3 = Discontinuity(Curve=brec_2.Bounding, Level=1)  # -> Points, Parameters
area = Area(Geometry=brec_2.Bounding)  # -> Area, Centroid
geo_5 = Geometry(arrlinear.Geometry)  # disabled
geo_6 = Geometry(arrlinear_2.Geometry)  # disabled
geo_7 = Geometry(arrlinear_4.Geometry)  # disabled
geo_8 = Geometry(arrlinear_3.Geometry)  # disabled
item_3 = ListItem(List=disc_3.Points, Index=0, Wrap=True)
xz_3 = XZPlane(Origin=item_3)
random = Random(Range=Domain(0, 1), Number=Slider(6, range=0..10), Seed=Slider(4, range=0..10))
random_2 = Random(Range=Domain(0, 1), Number=Slider(6, range=0..10), Seed=Slider(2, range=0..10))
division_2 = Division(A=brec_2.DimensionX, B=number_slider_13)
division_3 = Division(A=brec_2.DimensionY, B=Slider(5.2, range=0..10))
hexgrid = Hexagonal(Plane=xz_3, Size=number_slider_13, ExtentX=division_2, ExtentY=division_3)  # -> simplify(Cells), Points
pt_2 = ConstructPoint(XCoordinate=random, YCoordinate=random_2, ZCoordinate=0)
path_mapper = PathMapper(hexgrid.Cells, source="{A;B}", target="{A}")
evalsrf = EvaluateSurface(Surface=reparameterize(brec_2.Bounding), Point=simplify(graft(pt_2)))  # -> Point, Normal, UDirection, VDirection, Frame
brec_3 = BoundingRectangle(Geometry=path_mapper, Plane=xz_2, Axis=0, Slide=0, Union=True)  # -> simplify(Bounding), DimensionX, DimensionY
area_2 = Area(Geometry=brec_3.Bounding)  # -> Area, Centroid

geo_9 = Geometry(extr_8)
geo_10 = Geometry(extr_3)
geo_11 = Geometry(extr)

ln = Line(StartPoint=area_2.Centroid, EndPoint=area.Centroid)
move_5 = Move(Geometry=path_mapper, Motion=ln)  # -> Geometry, Transform
trim = TrimWithRegion(Curve=move_5.Geometry, Region=crv_13)  # -> simplify(Inside), Outside
crv_15 = Curve(trim.Inside)
path_mapper_2 = PathMapper(crv_15, source="{A;B}", target="{A}")
srfsplit_3 = SurfaceSplit(Surface=brec_2.Bounding, Curves=path_mapper_2)
crv_16 = Curve(srfsplit_3)
area_3 = Area(Geometry=crv_16)  # -> Area, Centroid
point_attractor = PointAttractor(A_2=evalsrf.Point, B_2=area_3.Centroid, A=Slider(0.8, range=0..1), B=Slider(0.06, range=0..1))
scale = Scale(Geometry=crv_16, Center=area_3.Centroid, Factor=point_attractor)  # -> Geometry, Transform
crv_17 = Curve(scale.Geometry)

# ==== cluster PointAttractor: Utility
A = ClusterInput()
x = ClusterInput()
A_2 = ClusterInput()
B = ClusterInput()
B_2 = ClusterInput()
dist = Distance(PointA=A_2, PointB=B_2)
dom = ConstructDomain(DomainStart=A, DomainEnd=B)
bnd = Bounds(Numbers=dist)
remap = RemapNumbers(Value=dist, Source=bnd, Target=dom)  # -> Mapped, Clipped
R = ClusterOutput(remap.Mapped)
