# Grasshopper definition parametric-sandbox-v0.4-pattern_test.gh (Grasshopper 1.0.8)

number_slider = Slider(36, range=0..100)
pt = Point(Point(0, 0, 0))
cell_scale = Number(Slider(6, range=0..10))
extent_x = Number(number_slider)
origin = Point(pt)
extent_y = Number(number_slider)
hex_grid_generator = HexGridGenerator(origin_point=origin, cell_scale=cell_scale, x_axis_extent=extent_x, y_axis_extent=extent_y)  # -> grid_cell_curves_2, grid_area_centroids
pattsel = Python3Script(Index=Slider(85, range=0..119))  # -> Values; inputs Index: Int32
# ---------- pattsel: Python ----------
import itertools

# 1. Generate all possible 7-bit combinations
all_combinations = list(itertools.product([0, 1], repeat=7))

# 2. Filter to keep only those with at least two 1s
valid_combinations = [comb for comb in all_combinations if sum(comb) >= 2]

# 3. Output the selected combination based on the input index
if Index is not None:
    # Ensure the index stays within the valid range (0-119)
    safe_index = max(0, min(int(Index), len(valid_combinations) - 1))
    
    # Assign the combination to the output variable as a list
    # Grasshopper will automatically output this as 7 distinct items
    Values = list(valid_combinations[safe_index])
else:
    Values = []
# ---------- end pattsel ----------
pattselutil = PattSelUtil(
    area_centroid=Slider(0, range=0..1),
    out_mid=Slider(0, range=0..1),
    out_vert=Slider(1, range=0..1),
    out_eval=Slider(1, range=0..1),
    in_mid=Slider(1, range=0..1),
    in_vert=Slider(0, range=0..1),
    in_eval=Slider(1, range=0..1))
pattgen = PattGen(
    grid_cells=hex_grid_generator.grid_cell_curves_2,
    scale_in=Slider(0.33, range=0..1),
    eval_out=Slider(0.39, range=0..1),
    eval_in=Slider(0.23, range=0..1),
    point_toggle=pattsel)

# ==== cluster HexGridGenerator: Grid Gen
y_axis_extent = ClusterInput()
x_axis_extent = ClusterInput()
in = ClusterInput()  # "---------------------"
origin_point = ClusterInput()
cell_scale = ClusterInput()
y_axis_extent_2 = Number(y_axis_extent)
x_axis_extent_2 = Number(x_axis_extent)
cell_scale_2 = Number(cell_scale)
origin_point_2 = Point(origin_point)
division = Division(XAxisExtent=x_axis_extent_2, B=cell_scale_2)
division_2 = Division(YAxisExtent=y_axis_extent_2, B=cell_scale_2)
hexgrid = Hexagonal(Plane=origin_point_2, Size=cell_scale_2, ExtentX=division, ExtentY=division_2)  # -> Cells, Points
grid_cell_curves = Curve(hexgrid.Cells)
area = Area(Geometry=grid_cell_curves)  # -> Area, GridAreaCentroids
grid_area_centroids = ClusterOutput(area.GridAreaCentroids)
grid_cell_curves_2 = ClusterOutput(grid_cell_curves)

# ==== cluster PattGen
scale_in = ClusterInput()
eval_out = ClusterInput()
eval_in = ClusterInput()
grid_cells = ClusterInput()
scale_in_2 = Number(scale_in)
eval_in_2 = Number(eval_in)
grid_cells_2 = Curve(grid_cells)
eval_out_2 = Number(eval_out)
crv = Curve(flatten(grid_cells_2))
crv_2 = Curve(graft(crv))
point_toggle = ClusterInput()
explode = Explode(Curve=crv_2, Recursive=True)  # -> Segments, Vertices
area = Area(Geometry=crv_2)  # -> Area, Centroid
scale = Scale(Geometry=crv_2, Center=area.Centroid, Factor=scale_in_2)  # -> Geometry, Transform
explode_2 = Explode(Curve=scale.Geometry, Recursive=True)  # -> Segments, Vertices
eval = EvaluateCurve(Curve=reparameterize(explode_2.Segments), Parameter=eval_in_2)  # -> Point, Tangent, Angle
end = EndPoints(Curve=explode.Segments)  # -> Start, End
midpt = CurveMiddle(Curve=explode.Segments)
point_toggle_2 = Data(point_toggle)
eval_2 = EvaluateCurve(Curve=reparameterize(explode.Segments), Parameter=eval_out_2)  # -> Point, Tangent, Angle
midpt_2 = CurveMiddle(Curve=explode_2.Segments)
end_2 = EndPoints(Curve=explode_2.Segments)  # -> Start, End
item = ListItem(List=point_toggle_2, Index=0, Wrap=True)  # -> Item, Item1, Item2, Item3, Item4, Item5, Item6
pt = Point(simplify(end_2.Start))
pt_2 = Point(simplify(eval.Point))
pt_3 = Point(simplify(area.Centroid))
pt_4 = Point(simplify(midpt_2))
pt_5 = Point(simplify(end.Start))
pt_6 = Point(simplify(eval_2.Point))
pt_7 = Point(simplify(midpt))
in_mid = Boolean(item.Item4)
area_centroid = Boolean(item.Item)
in_eval = Boolean(item.Item6)
in_vert = Boolean(item.Item5)
out_vert = Boolean(item.Item2)
out_mid = Boolean(item.Item1)
out_eval = Boolean(item.Item3)
py3 = Python3Script(data=pt_4, toggle=in_mid)  # -> out_data; inputs data: tree, toggle: Boolean
# ---------- py3: Python ----------
import Grasshopper as gh

# Check if the toggle is set to True
if toggle:
    # Pass the data through exactly as it is
    out_data = data
else:
    # Output an empty DataTree to block the stream completely
    out_data = gh.DataTree[object]()
# ---------- end py3 ----------
py3_2 = Python3Script(data=pt_2, toggle=in_eval)  # -> out_data; inputs data: tree, toggle: Boolean; same code as py3
py3_3 = Python3Script(data=pt, toggle=in_vert)  # -> out_data; inputs data: tree, toggle: Boolean; same code as py3
py3_4 = Python3Script(data=pt_5, toggle=out_vert)  # -> out_data; inputs data: tree, toggle: Boolean; same code as py3
py3_5 = Python3Script(data=pt_3, toggle=area_centroid)  # -> out_data; inputs data: tree, toggle: Boolean; same code as py3
py3_6 = Python3Script(data=pt_7, toggle=out_mid)  # -> out_data; inputs data: tree, toggle: Boolean; same code as py3
py3_7 = Python3Script(data=pt_6, toggle=out_eval)  # -> out_data; inputs data: tree, toggle: Boolean; same code as py3
merge = Merge(Data1=py3_5, Data2=py3_6, Data3=py3_4, Data4=py3_7, Data5=py3, Data6=py3_3, Data7=py3_2)
voronoi = Voronoi(Points=merge, BruteForceOverride=False)
srfsplit = SurfaceSplit(Surface=simplify(crv_2), Curves=simplify(voronoi))
pattern_curves = Curve(srfsplit)
pattern_curves_2 = ClusterOutput(pattern_curves)

# ==== cluster PattSelUtil
area_centroid = ClusterInput()
in_vert = ClusterInput()
out_vert = ClusterInput()
in_mid = ClusterInput()
in_eval = ClusterInput()
out_mid = ClusterInput()
out_eval = ClusterInput()
area_centroid_2 = Boolean(area_centroid)
in_mid_2 = Boolean(in_mid)
in_eval_2 = Boolean(in_eval)
in_vert_2 = Boolean(in_vert)
out_vert_2 = Boolean(out_vert)
out_mid_2 = Boolean(out_mid)
out_eval_2 = Boolean(out_eval)
merge = Merge(
    Data1=area_centroid_2,
    Data2=out_mid_2,
    Data3=out_vert_2,
    Data4=out_eval_2,
    Data5=in_mid_2,
    Data6=in_vert_2,
    Data7=in_eval_2)
point_toggle = Data(merge)
point_toggle_2 = ClusterOutput(point_toggle)
