# Grasshopper definition parametric-sandbox-v0.5-general.gh (Grasshopper 1.0.8)

rectangle = Rectangle(Plane=PlaneXY(0, 0, 0), XSize=Slider(240, range=0..1000), YSize=Slider(144, range=0..1000), Radius=0)  # -> Rectangle, Length
prim_rect = Curve(rectangle.Rectangle)
number_slider = Slider(2, range=0..10)
crv = Curve(prim_rect)
crv_2 = Curve(prim_rect)
bound_pan_offsets = BoundPanOffsets(bound=crv, prim_offset=number_slider, rect_div_x=Slider(3, range=0..10), rect_div_y=Slider(2, range=0..10))  # -> offset_curves_2, interior_curves_2
bound_pan_offsets_2 = BoundPanOffsets(bound=crv_2, prim_offset=Slider(4, range=0..10), rect_div_x=Slider(3, range=0..10), rect_div_y=Slider(1, range=0..10))  # -> offset_curves_2, interior_curves_2
crv_3 = Curve(bound_pan_offsets_2.interior_curves_2)
bound_pan_offsets_3 = BoundPanOffsets(bound=crv_3, prim_offset=Slider(1, range=0..10), rect_div_x=Slider(6, range=0..10), rect_div_y=Slider(2, range=0..10))  # -> offset_curves_2, interior_curves_2
neg = Negative(Value=number_slider)
crv_4 = Curve(bound_pan_offsets.interior_curves_2)
merge = Merge(Data1=neg, Data2=number_slider, Data3=number_slider, Data4=neg)
merge_2 = Merge(Data1=neg, Data2=neg, Data3=number_slider, Data4=number_slider)
disc = Discontinuity(Curve=crv_4, Level=1)  # -> Points, Parameters
rectangle_2 = Rectangle(Plane=disc.Points, XSize=merge, YSize=merge_2, Radius=0)  # -> flatten(Rectangle), Length
crv_5 = Curve(bound_pan_offsets_3.offset_curves_2)
crv_6 = Curve(bound_pan_offsets_3.interior_curves_2)
crv_7 = Curve(bound_pan_offsets.offset_curves_2)
crv_8 = Curve(rectangle_2.Rectangle)
crv_9 = Curve(bound_pan_offsets.interior_curves_2)
crv_10 = Curve(bound_pan_offsets_2.offset_curves_2)
crv_11 = Curve(bound_pan_offsets_2.interior_curves_2)
crv_12 = Curve(crv_9)
offset = OffsetCurve(Curve=crv_12, Distance=Slider(0.75, range=0..1), Corners=1)
boundgrid = BoundGrid(B=offset, RadX=Slider(3, range=0..10), Type=Slider(2, range=0..10))  # -> GridCells, R, C; inputs B: Curve, RadX: Double, RadY: Double, Type: Boolean
# ---------- boundgrid: Python ----------
import math
import Rhino
from Rhino.Geometry import Point3d, Polyline, PolylineCurve
from Rhino.Geometry.Intersect import Intersection
from Grasshopper import DataTree
from Grasshopper.Kernel.Data import GH_Path

def _is_closed_planar(crv, tol):
    if crv is None: return False
    if not crv.IsClosed: return False
    ok, _ = crv.TryGetPlane(tol)
    return ok

def _curve_plane(crv, tol):
    ok, pln = crv.TryGetPlane(tol)
    return pln if ok else None

def _hex_pts_xy(cx, cy, rx, ry):
    # pointy-top hex; rx stretches X, ry stretches Y
    pts = []
    for k in range(6):
        ang = math.radians(30.0 + 60.0 * k)
        pts.append((cx + rx * math.cos(ang), cy + ry * math.sin(ang)))
    return pts

def _rect_pts_xy(cx, cy, rx, ry):
    # axis-aligned rectangle; if rx==ry it's a square
    return [
        (cx - rx, cy - ry),
        (cx + rx, cy - ry),
        (cx + rx, cy + ry),
        (cx - rx, cy + ry),
    ]

def _poly_fully_inside(cell_crv, boundary, plane, tol):
    ok, pl = cell_crv.TryGetPolyline()
    if not ok:
        return False

    # all vertices must be inside (or on boundary)
    for i in range(pl.Count - 1):
        if boundary.Contains(pl[i], plane, tol) == Rhino.Geometry.PointContainment.Outside:
            return False

    # any intersection (including touching) rejects
    x = Intersection.CurveCurve(cell_crv, boundary, tol, tol)
    if x and x.Count > 0:
        return False

    return True

# ----------------------------
# Main
# ----------------------------
GridCells = []
R = DataTree[object]()  # rows
C = DataTree[object]()  # cols

if B is None or RadX is None:
    GridCells = []
else:
    tol = Rhino.RhinoDoc.ActiveDoc.ModelAbsoluteTolerance if Rhino.RhinoDoc.ActiveDoc else 1e-6

    rx = float(RadX)
    if rx <= 0.0:
        GridCells = []
    else:
        # Critical rule: if RadY == 0 -> regular polygons
        if RadY is None:
            ry = rx
        else:
            ry_in = float(RadY)
            ry = rx if abs(ry_in) <= tol else ry_in

        if not _is_closed_planar(B, tol):
            GridCells = []
        else:
            plane = _curve_plane(B, tol)

            # boundary plane coords -> World XY
            xform_w2p = Rhino.Geometry.Transform.ChangeBasis(plane, Rhino.Geometry.Plane.WorldXY)
            xform_p2w = Rhino.Geometry.Transform.ChangeBasis(Rhino.Geometry.Plane.WorldXY, plane)

            B2 = B.DuplicateCurve()
            B2.Transform(xform_w2p)

            mp = Rhino.Geometry.AreaMassProperties.Compute(B2)
            ctr2 = mp.Centroid if mp else B2.GetBoundingBox(True).Center

            use_hex = True if Type else False

            # Grid spacing derived from rx/ry
            if use_hex:
                dx = math.sqrt(3.0) * rx
                dy = 1.5 * ry
            else:
                dx = 2.0 * rx
                dy = 2.0 * ry

            bb = B2.GetBoundingBox(True)
            minx = bb.Min.X - 2.0 * dx
            maxx = bb.Max.X + 2.0 * dx
            miny = bb.Min.Y - 2.0 * dy
            maxy = bb.Max.Y + 2.0 * dy

            j_min = int(math.floor((miny - ctr2.Y) / dy)) - 1
            j_max = int(math.ceil((maxy - ctr2.Y) / dy)) + 1
            i_min = int(math.floor((minx - ctr2.X) / dx)) - 1
            i_max = int(math.ceil((maxx - ctr2.X) / dx)) + 1

            cells_by_row = {}  # j -> list of (i, curve)
            cells_by_col = {}  # i -> list of (j, curve)

            for j in range(j_min, j_max + 1):
                y = ctr2.Y + j * dy
                row_offset = (0.5 * dx if (use_hex and (j & 1)) else 0.0)

                for i in range(i_min, i_max + 1):
                    x = ctr2.X + i * dx + row_offset
                    cpt2 = Point3d(x, y, 0.0)

                    # quick cull: center must be inside
                    if B2.Contains(cpt2, Rhino.Geometry.Plane.WorldXY, tol) == Rhino.Geometry.PointContainment.Outside:
                        continue

                    # build candidate cell in plane coords (WorldXY)
                    if use_hex:
                        verts = _hex_pts_xy(x, y, rx, ry)
                    else:
                        verts = _rect_pts_xy(x, y, rx, ry)

                    pts = [Point3d(vx, vy, 0.0) for (vx, vy) in verts]
                    pts.append(pts[0])

                    pline = Polyline(pts)
                    if not pline.IsValid:
                        continue

                    cell2 = PolylineCurve(pline)

                    if not _poly_fully_inside(cell2, B2, Rhino.Geometry.Plane.WorldXY, tol):
                        continue

                    cell_w = cell2.DuplicateCurve()
                    cell_w.Transform(xform_p2w)

                    GridCells.append(cell_w)
                    cells_by_row.setdefault(j, []).append((i, cell_w))
                    cells_by_col.setdefault(i, []).append((j, cell_w))

            # Rows -> R (branches ordered by j, items ordered by i)
            row_keys = sorted(cells_by_row.keys())
            for r_idx, j in enumerate(row_keys):
                path = GH_Path(r_idx)
                for (_, crv) in sorted(cells_by_row[j], key=lambda t: t[0]):
                    R.Add(crv, path)

            # Cols -> C (branches ordered by i, items ordered by j)
            col_keys = sorted(cells_by_col.keys())
            for c_idx, i in enumerate(col_keys):
                path = GH_Path(c_idx)
                for (_, crv) in sorted(cells_by_col[i], key=lambda t: t[0]):
                    C.Add(crv, path)
# ---------- end boundgrid ----------
crv_13 = Curve(offset)
crv_14 = Curve(boundgrid.GridCells)
area = Area(Geometry=crv_14)  # -> Area, Centroid
scale = Scale(Geometry=crv_14, Center=area.Centroid, Factor=0.5)  # -> Geometry, Transform

# ==== cluster BoundPanOffsets
prim_offset = ClusterInput()
rect_div_y = ClusterInput()
rect_div_x = ClusterInput()
bound = ClusterInput()
prim_offset_2 = Number(prim_offset)
rect_div_x_2 = Number(rect_div_x)
rect_div_y_2 = Number(rect_div_y)
bound_2 = Curve(bound)
brec = BoundingRectangle(Geometry=bound_2, Plane=PlaneXY(0, 0, 0), Axis=0, Slide=0, Union=True)  # -> Bounding, DimensionX, DimensionY
neg = Negative(Value=prim_offset_2)
division = Division(A=prim_offset_2, B=2)
neg_2 = Negative(Value=division)
division_2 = Division(A=brec.DimensionX, B=rect_div_x_2)
division_3 = Division(A=brec.DimensionY, B=rect_div_y_2)
boundpanel = BoundPanel(Bnd=bound_2, SheetX=division_2, SheetY=division_3)  # -> Panels; inputs Bnd: Curve, SheetX: Double, SheetY: Double, UseWorldXY: Boolean
# ---------- boundpanel: Python ----------
import Rhino
import scriptcontext as sc
from Rhino.Geometry import Plane, Rectangle3d, Interval

# Inputs:
#   Bnd        : Curve
#   SheetX     : float
#   SheetY     : float
#   UseWorldXY : bool
#
# Output:
#   Panels     : list[Curve]


def _doc_tol():
    if sc.doc:
        return sc.doc.ModelAbsoluteTolerance
    if Rhino.RhinoDoc.ActiveDoc:
        return Rhino.RhinoDoc.ActiveDoc.ModelAbsoluteTolerance
    return 1e-3


def sizes_1d(L, S, tol):
    """
    Fills length L with:
    - as many full sheets S as possible
    - remainder split equally into two end caps
    - full sheets centered between caps
    """
    if S <= tol:
        return [L]

    n_full = int(L // S)
    rem = L - (n_full * S)

    if abs(rem) <= tol:
        return [S] * n_full

    cap = 0.5 * rem

    if cap <= tol:
        return [S] * n_full

    return [cap] + ([S] * n_full) + [cap]


Panels = []

if Bnd is None:
    Panels = []
else:
    tol = _doc_tol()

    # Choose working plane
    if UseWorldXY:
        pl = Plane.WorldXY
    else:
        ok, pl = Bnd.TryGetPlane(tol)
        if not ok:
            pl = Plane.WorldXY

    # Bounding box in chosen plane
    bb = Bnd.GetBoundingBox(pl)

    Lx = bb.Max.X - bb.Min.X
    Ly = bb.Max.Y - bb.Min.Y

    x_sizes = sizes_1d(Lx, float(SheetX), tol)
    y_sizes = sizes_1d(Ly, float(SheetY), tol)

    x0 = bb.Min.X
    for sx in x_sizes:
        y0 = bb.Min.Y
        for sy in y_sizes:
            rect = Rectangle3d(
                pl,
                Interval(x0, x0 + sx),
                Interval(y0, y0 + sy)
            )
            Panels.append(rect.ToNurbsCurve())
            y0 += sy
        x0 += sx
# ---------- end boundpanel ----------
offset = OffsetCurve(Curve=boundpanel, Distance=neg_2, Corners=1)
offset_2 = OffsetCurve(Curve=bound_2, Distance=neg, Corners=1)
boundary = BoundarySurfaces(Edges=flatten([bound_2, offset_2]))
boundary_2 = BoundarySurfaces(Edges=flatten([offset, boundpanel]))
sunion = SolidUnion(Breps=[boundary, boundary_2])
edges = BrepEdges(Brep=sunion)  # -> Naked, Interior, NonManifold
join = JoinCurves(Curves=edges.Naked, Preserve=False)
area = Area(Geometry=join)  # -> Area, Centroid
avr = Average(Input=area.Area)
larger = LargerThan(FirstNumber=area.Area, SecondNumber=0)  # -> LargerThan, OrEqualTo
smaller = SmallerThan(FirstNumber=area.Area, SecondNumber=avr)  # -> SmallerThan, OrEqualTo
cull_i = CullIndex(List=join, Wrap=True)
cull = CullPattern(List=join, CullPattern=smaller.SmallerThan)
offset_curves = Curve(flatten(join))
brec_2 = BoundingRectangle(Geometry=graft(cull), Plane=PlaneXY(0, 0, 0), Axis=0, Slide=0, Union=True)  # -> Bounding, DimensionX, DimensionY
interior_curves = Curve(flatten(brec_2.Bounding))
offset_curves_2 = ClusterOutput(offset_curves)
interior_curves_2 = ClusterOutput(interior_curves)
