# Grasshopper definition parametric-sandbox-v0.3.gh (Grasshopper 1.0.8)
# plug-ins: Pufferfish

number_slider = Slider(240, range=0..1000)  # disabled
number_slider_2 = Slider(180, range=0..1000)  # disabled
xz = XZPlane(Origin=Point(0, 0, 0))  # disabled
number_slider_3 = Slider(300, range=0..1000)  # disabled
rectangle = Rectangle(Plane=xz, XSize=number_slider, YSize=number_slider_2, Radius=0)  # -> Rectangle, Length; disabled

number_slider_4 = Slider(240, range=0..1000)  # disabled
number_slider_5 = Slider(240, range=0..1000)  # disabled
pt = Point(Point(0, 0, 0))  # disabled

subtraction = Subtraction(A=number_slider_3, B=number_slider_4)  # disabled
number_slider_6 = Slider(180, range=0..1000)  # disabled
number_slider_7 = Slider(240, range=0..1000)  # disabled
crv = Curve(rectangle.Rectangle)  # disabled
number_slider_8 = Slider(4, range=0..100)  # disabled
number_slider_9 = Slider(2, range=0..10)  # disabled
neg = Negative(Value=subtraction)  # disabled
rectangle_2 = Rectangle(Plane=PlaneXY(0, 0, 0), XSize=number_slider_7, YSize=number_slider_6, Radius=0)  # -> Rectangle, Length; disabled
number_slider_10 = Slider(120, range=0..1000)  # disabled
X = UnitX(Factor=neg)  # disabled
number_slider_11 = Slider(60, range=0..1000)  # disabled
boundary_panel = BoundaryPanel(Bnd=rectangle_2.Rectangle, SheetX=number_slider_10, SheetY=number_slider_11)  # -> Panels; inputs Bnd: Curve, SheetX: Double, SheetY: Double, UseWorldXY: Boolean; disabled
# ---------- boundary_panel: Python ----------
import Rhino
import scriptcontext as sc
from Rhino.Geometry import Plane, Rectangle3d, Interval

# Inputs:
#   Bnd        : Curve
#   SheetX     : float
#   SheetY     : float
#   UseWorldXY : bool
#
# Output:
#   Panels     : list[Curve]


def _doc_tol():
    if sc.doc:
        return sc.doc.ModelAbsoluteTolerance
    if Rhino.RhinoDoc.ActiveDoc:
        return Rhino.RhinoDoc.ActiveDoc.ModelAbsoluteTolerance
    return 1e-3


def sizes_1d(L, S, tol):
    """
    Fills length L with:
    - as many full sheets S as possible
    - remainder split equally into two end caps
    - full sheets centered between caps
    """
    if S <= tol:
        return [L]

    n_full = int(L // S)
    rem = L - (n_full * S)

    if abs(rem) <= tol:
        return [S] * n_full

    cap = 0.5 * rem

    if cap <= tol:
        return [S] * n_full

    return [cap] + ([S] * n_full) + [cap]


Panels = []

if Bnd is None:
    Panels = []
else:
    tol = _doc_tol()

    # Choose working plane
    if UseWorldXY:
        pl = Plane.WorldXY
    else:
        ok, pl = Bnd.TryGetPlane(tol)
        if not ok:
            pl = Plane.WorldXY

    # Bounding box in chosen plane
    bb = Bnd.GetBoundingBox(pl)

    Lx = bb.Max.X - bb.Min.X
    Ly = bb.Max.Y - bb.Min.Y

    x_sizes = sizes_1d(Lx, float(SheetX), tol)
    y_sizes = sizes_1d(Ly, float(SheetY), tol)

    x0 = bb.Min.X
    for sx in x_sizes:
        y0 = bb.Min.Y
        for sy in y_sizes:
            rect = Rectangle3d(
                pl,
                Interval(x0, x0 + sx),
                Interval(y0, y0 + sy)
            )
            Panels.append(rect.ToNurbsCurve())
            y0 += sy
        x0 += sx
# ---------- end boundary_panel ----------
grid_in_region = GridInRegion(B=rectangle_2.Rectangle, RadX=number_slider_8, Type=number_slider_9)  # -> GridCells, R, C; inputs B: Curve, RadX: Double, RadY: Double, Type: Boolean; disabled
# ---------- grid_in_region: Python ----------
import math
import Rhino
from Rhino.Geometry import Point3d, Polyline, PolylineCurve
from Rhino.Geometry.Intersect import Intersection
from Grasshopper import DataTree
from Grasshopper.Kernel.Data import GH_Path

def _is_closed_planar(crv, tol):
    if crv is None: return False
    if not crv.IsClosed: return False
    ok, _ = crv.TryGetPlane(tol)
    return ok

def _curve_plane(crv, tol):
    ok, pln = crv.TryGetPlane(tol)
    return pln if ok else None

def _hex_pts_xy(cx, cy, rx, ry):
    # pointy-top hex; rx stretches X, ry stretches Y
    pts = []
    for k in range(6):
        ang = math.radians(30.0 + 60.0 * k)
        pts.append((cx + rx * math.cos(ang), cy + ry * math.sin(ang)))
    return pts

def _rect_pts_xy(cx, cy, rx, ry):
    # axis-aligned rectangle; if rx==ry it's a square
    return [
        (cx - rx, cy - ry),
        (cx + rx, cy - ry),
        (cx + rx, cy + ry),
        (cx - rx, cy + ry),
    ]

def _poly_fully_inside(cell_crv, boundary, plane, tol):
    ok, pl = cell_crv.TryGetPolyline()
    if not ok:
        return False

    # all vertices must be inside (or on boundary)
    for i in range(pl.Count - 1):
        if boundary.Contains(pl[i], plane, tol) == Rhino.Geometry.PointContainment.Outside:
            return False

    # any intersection (including touching) rejects
    x = Intersection.CurveCurve(cell_crv, boundary, tol, tol)
    if x and x.Count > 0:
        return False

    return True

# ----------------------------
# Main
# ----------------------------
GridCells = []
R = DataTree[object]()  # rows
C = DataTree[object]()  # cols

if B is None or RadX is None:
    GridCells = []
else:
    tol = Rhino.RhinoDoc.ActiveDoc.ModelAbsoluteTolerance if Rhino.RhinoDoc.ActiveDoc else 1e-6

    rx = float(RadX)
    if rx <= 0.0:
        GridCells = []
    else:
        # Critical rule: if RadY == 0 -> regular polygons
        if RadY is None:
            ry = rx
        else:
            ry_in = float(RadY)
            ry = rx if abs(ry_in) <= tol else ry_in

        if not _is_closed_planar(B, tol):
            GridCells = []
        else:
            plane = _curve_plane(B, tol)

            # boundary plane coords -> World XY
            xform_w2p = Rhino.Geometry.Transform.ChangeBasis(plane, Rhino.Geometry.Plane.WorldXY)
            xform_p2w = Rhino.Geometry.Transform.ChangeBasis(Rhino.Geometry.Plane.WorldXY, plane)

            B2 = B.DuplicateCurve()
            B2.Transform(xform_w2p)

            mp = Rhino.Geometry.AreaMassProperties.Compute(B2)
            ctr2 = mp.Centroid if mp else B2.GetBoundingBox(True).Center

            use_hex = True if Type else False

            # Grid spacing derived from rx/ry
            if use_hex:
                dx = math.sqrt(3.0) * rx
                dy = 1.5 * ry
            else:
                dx = 2.0 * rx
                dy = 2.0 * ry

            bb = B2.GetBoundingBox(True)
            minx = bb.Min.X - 2.0 * dx
            maxx = bb.Max.X + 2.0 * dx
            miny = bb.Min.Y - 2.0 * dy
            maxy = bb.Max.Y + 2.0 * dy

            j_min = int(math.floor((miny - ctr2.Y) / dy)) - 1
            j_max = int(math.ceil((maxy - ctr2.Y) / dy)) + 1
            i_min = int(math.floor((minx - ctr2.X) / dx)) - 1
            i_max = int(math.ceil((maxx - ctr2.X) / dx)) + 1

            cells_by_row = {}  # j -> list of (i, curve)
            cells_by_col = {}  # i -> list of (j, curve)

            for j in range(j_min, j_max + 1):
                y = ctr2.Y + j * dy
                row_offset = (0.5 * dx if (use_hex and (j & 1)) else 0.0)

                for i in range(i_min, i_max + 1):
                    x = ctr2.X + i * dx + row_offset
                    cpt2 = Point3d(x, y, 0.0)

                    # quick cull: center must be inside
                    if B2.Contains(cpt2, Rhino.Geometry.Plane.WorldXY, tol) == Rhino.Geometry.PointContainment.Outside:
                        continue

                    # build candidate cell in plane coords (WorldXY)
                    if use_hex:
                        verts = _hex_pts_xy(x, y, rx, ry)
                    else:
                        verts = _rect_pts_xy(x, y, rx, ry)

                    pts = [Point3d(vx, vy, 0.0) for (vx, vy) in verts]
                    pts.append(pts[0])

                    pline = Polyline(pts)
                    if not pline.IsValid:
                        continue

                    cell2 = PolylineCurve(pline)

                    if not _poly_fully_inside(cell2, B2, Rhino.Geometry.Plane.WorldXY, tol):
                        continue

                    cell_w = cell2.DuplicateCurve()
                    cell_w.Transform(xform_p2w)

                    GridCells.append(cell_w)
                    cells_by_row.setdefault(j, []).append((i, cell_w))
                    cells_by_col.setdefault(i, []).append((j, cell_w))

            # Rows -> R (branches ordered by j, items ordered by i)
            row_keys = sorted(cells_by_row.keys())
            for r_idx, j in enumerate(row_keys):
                path = GH_Path(r_idx)
                for (_, crv) in sorted(cells_by_row[j], key=lambda t: t[0]):
                    R.Add(crv, path)

            # Cols -> C (branches ordered by i, items ordered by j)
            col_keys = sorted(cells_by_col.keys())
            for c_idx, i in enumerate(col_keys):
                path = GH_Path(c_idx)
                for (_, crv) in sorted(cells_by_col[i], key=lambda t: t[0]):
                    C.Add(crv, path)
# ---------- end grid_in_region ----------
number_slider_12 = Slider(2, range=0..10)  # disabled
rectangle_3 = Rectangle(Plane=pt, XSize=number_slider_4, YSize=number_slider_5, Radius=0)  # -> Rectangle, Length; disabled
number_slider_13 = Slider(80, range=0..1000)  # disabled
number_slider_14 = Slider(360, range=0..1000)  # disabled
number_slider_15 = Slider(90, range=0..1000)  # disabled
number_slider_16 = Slider(8, range=0..10)  # disabled
neg_2 = Negative(Value=number_slider_12)  # disabled
number_slider_17 = Slider(12, range=0..100)  # disabled

number_slider_18 = Slider(60, range=0..1000)  # disabled
number_slider_19 = Slider(1, range=0..10)  # disabled

number_slider_20 = Slider(1.5, range=0..10)  # disabled

number_slider_21 = Slider(180, range=0..1000)  # disabled
number_slider_22 = Slider(12, range=0..1000)  # disabled
number_slider_23 = Slider(3, range=0..10)  # disabled

Z = UnitZ(Factor=number_slider_21)  # disabled
move = Move(Geometry=pt, Motion=Z)  # -> Geometry, Transform; disabled
rectangle_4 = Rectangle(Plane=move.Geometry, XSize=number_slider_3, YSize=number_slider_5, Radius=0)  # -> Rectangle, Length; disabled
move_2 = Move(Geometry=rectangle_4.Rectangle, Motion=X)  # -> Geometry, Transform; disabled

number_slider_24 = Slider(6, range=0..10)  # disabled
number_slider_25 = Slider(4, range=0..10)  # disabled

srf = Surface(crv)  # disabled
crv_2 = Curve(rectangle_3.Rectangle)  # disabled
Y = UnitY(Factor=number_slider_14)  # disabled
disc = Discontinuity(Curve=crv_2, Level=1)  # -> Points, Parameters; disabled
neg_3 = Negative(Value=number_slider_16)  # disabled
neg_4 = Negative(Value=number_slider_20)  # disabled
offset = OffsetCurve(Curve=crv, Distance=neg_2, Corners=1)  # disabled
neg_5 = Negative(Value=number_slider_17)  # disabled
boundary_panel_2 = BoundaryPanel(Bnd=crv, SheetX=number_slider_13, SheetY=number_slider_15)  # -> Panels; inputs Bnd: Curve, SheetX: Double, SheetY: Double, UseWorldXY: Boolean; disabled; same code as boundary_panel
disc_2 = Discontinuity(Curve=crv_2, Level=1)  # -> Points, Parameters; disabled
extr = Extrude(Base=srf, Direction=Y)  # disabled
item = ListItem(List=disc.Points, Index=0, Wrap=True)  # disabled
srf_2 = Surface(crv_2)  # disabled
offset_2 = OffsetCurve(Curve=boundary_panel, Distance=neg_4, Corners=1)  # disabled
number_slider_26 = Slider(2, range=0..10)  # disabled
offset_3 = OffsetCurve(Curve=crv, Distance=neg_3, Corners=1)  # disabled
offset_4 = OffsetCurve(Curve=crv, Distance=neg_5, Corners=1)  # disabled
number_slider_27 = Slider(0.5, range=0..10)  # disabled
Z_2 = UnitZ(Factor=number_slider_22)  # disabled
crv_3 = Curve(offset)  # disabled
crv_4 = Curve(boundary_panel_2)  # disabled
neg_6 = Negative(Value=number_slider_24)  # disabled
crv_5 = Curve(graft(boundary_panel))  # disabled
crv_6 = Curve(boundary_panel_2)  # disabled
multiplication = Multiplication(A=number_slider_25, B=2)  # disabled
crv_7 = Curve(offset_2)  # disabled
number_slider_28 = Slider(4, range=0..10)  # disabled
crv_8 = Curve(offset_4)  # disabled
neg_7 = Negative(Value=number_slider_26)  # disabled
neg_8 = Negative(Value=multiplication)  # disabled
dom = ConstructDomain(DomainStart=number_slider_24, DomainEnd=neg_6)  # disabled
srfsplit = SurfaceSplit(Surface=crv_3, Curves=crv_4)  # disabled
dom_2 = ConstructDomain(DomainStart=multiplication, DomainEnd=neg_8)  # disabled
neg_9 = Negative(Value=number_slider_27)  # disabled
crv_9 = Curve(offset_3)  # disabled
boundary = BoundarySurfaces(Edges=[crv_5, crv_7])  # disabled
offset_5 = OffsetCurve(Curve=crv_8, Distance=neg_7, Corners=1)  # disabled
move_3 = Move(Geometry=crv_2, Motion=Z_2)  # -> Geometry, Transform; disabled
rectangle_5 = Rectangle(Plane=PlaneXY(0, 0, 0), XSize=Domain(-1, 1), YSize=Domain(-2, 2), Radius=0)  # -> Rectangle, Length; disabled
neg_10 = Negative(Value=number_slider_23)  # disabled
subtraction_2 = Subtraction(A=number_slider_21, B=number_slider_22)  # disabled
crv_10 = Curve(srfsplit)  # disabled
rectangle_6 = Rectangle(Plane=disc_2.Points, XSize=dom_2, YSize=dom, Radius=0)  # -> Rectangle, Length; disabled
Z_3 = UnitZ(Factor=number_slider_20)  # disabled
neg_11 = Negative(Value=number_slider_28)  # disabled
offset_6 = OffsetCurve(Curve=move_3.Geometry, Distance=neg_10, Corners=1)  # disabled
offset_7 = OffsetCurve(Curve=crv_10, Distance=neg_9, Corners=1)  # disabled
neg_12 = Negative(Value=Z_3)  # disabled
Z_4 = UnitZ(Factor=number_slider_21)  # disabled
srf_3 = Surface(crv_9)  # disabled
srf_4 = Surface(rectangle_6.Rectangle)  # disabled
Y_2 = UnitY(Factor=neg_11)  # disabled
extr_2 = Extrude(Base=boundary, Direction=neg_12)  # disabled
srf_5 = Surface(offset_6)  # disabled
brec = BoundingRectangle(Geometry=srf_5, Plane=PlaneXY(0, 0, 0), Axis=0, Slide=0, Union=True)  # -> Bounding, DimensionX, DimensionY; disabled
Z_5 = UnitZ(Factor=subtraction_2)  # disabled
number_slider_29 = Slider(6.0625, range=0..10)  # disabled
srfsplit_2 = SurfaceSplit(Surface=offset_5, Curves=crv_6)  # disabled
extr_3 = Extrude(Base=srf_3, Direction=Y_2)  # disabled
division = Division(A=brec.DimensionX, B=number_slider_18)  # disabled
number_slider_30 = Slider(1, range=0..1)  # disabled
crv_11 = Curve(srfsplit_2)  # disabled
neg_13 = Negative(Value=number_slider_29)  # disabled
neg_14 = Negative(Value=number_slider_30)  # disabled
sdivide = DivideSurface(Surface=srf_5, UCount=1, VCount=division)  # -> Points, Normals, Parameters; disabled
neg_15 = Negative(Value=number_slider_19)  # disabled
flip = FlipMatrix(Data=sdivide.Points)  # disabled
Y_3 = UnitY(Factor=neg_13)  # disabled
offset_8 = OffsetCurve(Curve=crv_11, Distance=neg_14, Corners=1)  # -> flatten(Curve); disabled
dom_3 = ConstructDomain(DomainStart=number_slider_19, DomainEnd=neg_15)  # disabled
item_2 = ListItem(List=flip, Index=0, Wrap=True)  # disabled
gl_setback = Slider(5, range=0..100)
mod_width = Slider(16, range=0..100)
mod_depth = Slider(20, range=0..100)
mod_height = Slider(12, range=0..100)
move_4 = Move(Geometry=offset_7, Motion=Y_3)  # -> Geometry, Transform; disabled
rectangle_7 = Rectangle(Plane=flatten(item_2), XSize=dom_3, YSize=dom_3, Radius=0)  # -> Rectangle, Length; disabled
crv_12 = Curve(offset_8)  # disabled
srf_6 = Surface(rectangle_7.Rectangle)  # disabled
number_slider_31 = Slider(6, range=0..10)  # disabled
crv_13 = Curve(move_4.Geometry)  # disabled
extr_4 = Extrude(Base=srf_2, Direction=Z_2)  # disabled
extr_5 = Extrude(Base=srf_5, Direction=Z_5)  # disabled
extr_6 = Extrude(Base=srf_4, Direction=Z_4)  # disabled
extr_7 = Extrude(Base=srf_6, Direction=Z_5)  # disabled
crv_14 = Curve(flatten([crv_8, crv_12]))  # disabled
geo = Geometry(extr_4)  # disabled
geo_2 = Geometry(extr_5)  # disabled
geo_3 = Geometry(extr_6)  # disabled
geo_4 = Geometry(extr_7)  # disabled
Y_4 = UnitY(Factor=number_slider_5)  # disabled
neg_16 = Negative(Value=number_slider_31)  # disabled
boundary_2 = BoundarySurfaces(Edges=crv_14)  # disabled
Y_5 = UnitY(Factor=neg_16)  # disabled
srf_7 = Surface(crv_13)  # disabled
extr_8 = Extrude(Base=boundary_2, Direction=Y_5)  # disabled
xz_2 = XZPlane(Origin=Point(0, 0, 0))  # disabled
number_slider_32 = Slider(5, range=0..10)  # disabled
brec_2 = BoundingRectangle(Geometry=crv_13, Plane=xz_2, Axis=0, Slide=0, Union=True)  # -> simplify(Bounding), simplify(DimensionX), simplify(DimensionY); disabled
number_slider_33 = Slider(3, range=0..100)  # disabled
number_slider_34 = Slider(5.2, range=0..10)  # disabled
number_slider_35 = Slider(5, range=0..100)  # disabled
arrlinear = LinearArray(Geometry=geo, Direction=Y_4, Count=number_slider_32)  # -> Geometry, Transform; disabled
arrlinear_2 = LinearArray(Geometry=geo_2, Direction=Y_4, Count=number_slider_32)  # -> Geometry, Transform; disabled
arrlinear_3 = LinearArray(Geometry=geo_3, Direction=Y_4, Count=number_slider_32)  # -> flatten(Geometry), Transform; disabled
arrlinear_4 = LinearArray(Geometry=geo_4, Direction=Y_4, Count=number_slider_32)  # -> flatten(Geometry), Transform; disabled
disc_3 = Discontinuity(Curve=brec_2.Bounding, Level=1)  # -> Points, Parameters; disabled
area = Area(Geometry=brec_2.Bounding)  # -> Area, Centroid; disabled
number_slider_36 = Slider(6, range=0..10)  # disabled
number_slider_37 = Slider(6, range=0..10)  # disabled
number_slider_38 = Slider(4, range=0..10)  # disabled
number_slider_39 = Slider(2, range=0..10)  # disabled
neg_17 = Negative(Value=Slider(0.25, range=0..10))
neg_18 = Negative(Value=Slider(0.75, range=0..10))
geo_5 = Geometry(arrlinear.Geometry)  # disabled
geo_6 = Geometry(arrlinear_2.Geometry)  # disabled
geo_7 = Geometry(arrlinear_4.Geometry)  # disabled
geo_8 = Geometry(arrlinear_3.Geometry)  # disabled
item_3 = ListItem(List=disc_3.Points, Index=0, Wrap=True)  # disabled
xz_3 = XZPlane(Origin=item_3)  # disabled
random = Random(Range=Domain(0, 1), Number=number_slider_36, Seed=number_slider_38)  # disabled
random_2 = Random(Range=Domain(0, 1), Number=number_slider_37, Seed=number_slider_39)  # disabled
division_2 = Division(A=brec_2.DimensionX, B=number_slider_33)  # disabled
division_3 = Division(A=brec_2.DimensionY, B=number_slider_34)  # disabled
hexgrid = Hexagonal(Plane=xz_3, Size=number_slider_33, ExtentX=division_2, ExtentY=division_3)  # -> simplify(Cells), Points; disabled
pt_2 = ConstructPoint(XCoordinate=random, YCoordinate=random_2, ZCoordinate=0)  # disabled
multiplication_2 = Multiplication(A=gl_setback, B=12)
path_mapper = PathMapper(hexgrid.Cells, source="{A;B}", target="{A}")  # disabled
num = Number(multiplication_2)
cell_rad = Slider(3, range=0..10)
grid_type = Slider(2, range=0..10)
evalsrf = EvaluateSurface(Surface=reparameterize(brec_2.Bounding), Point=simplify(graft(pt_2)))  # -> Point, Normal, UDirection, VDirection, Frame; disabled
brec_3 = BoundingRectangle(Geometry=path_mapper, Plane=xz_2, Axis=0, Slide=0, Union=True)  # -> simplify(Bounding), DimensionX, DimensionY; disabled
pt_3 = ConstructPoint(XCoordinate=0, YCoordinate=num, ZCoordinate=0)
multiplication_3 = Multiplication(A=mod_width, B=12)
multiplication_4 = Multiplication(A=mod_depth, B=12)
multiplication_5 = Multiplication(A=mod_height, B=12)
area_2 = Area(Geometry=brec_3.Bounding)  # -> Area, Centroid; disabled

geo_9 = Geometry(extr_8)  # disabled
geo_10 = Geometry(extr_3)  # disabled
geo_11 = Geometry(extr)  # disabled

pt_4 = Point(pt_3)
num_2 = Number(multiplication_3)
mod_width_2 = Number(num_2)
division_4 = Division(A=mod_width_2, B=Slider(3, range=0..10))
num_3 = Number(multiplication_4)
addition = Addition(A=num_3, B=num)
num_4 = Number(multiplication_5)
mod_height_2 = Number(num_4)
pt_5 = ConstructPoint(XCoordinate=0, YCoordinate=0, ZCoordinate=num_4)
pt_6 = Point(pt_5)
ln = Line(StartPoint=area_2.Centroid, EndPoint=area.Centroid)  # disabled
move_5 = Move(Geometry=path_mapper, Motion=ln)  # -> Geometry, Transform; disabled
trim = TrimWithRegion(Curve=move_5.Geometry, Region=crv_13)  # -> simplify(Inside), Outside; disabled
rectangle_8 = Rectangle(Plane=pt_6, XSize=num_2, YSize=addition, Radius=0)  # -> Rectangle, Length
rectangle_9 = Rectangle(Plane=pt_4, XSize=num_2, YSize=num_3, Radius=0)  # -> Rectangle, Length
crv_15 = Curve(trim.Inside)  # disabled
Z_6 = UnitZ(Factor=num_4)
srf_8 = Surface(rectangle_8.Rectangle)
path_mapper_2 = PathMapper(crv_15, source="{A;B}", target="{A}")  # disabled
X_2 = UnitX(Factor=num_2)
srf_9 = Surface(rectangle_9.Rectangle)
number_slider_40 = Slider(0.8, range=0..1)  # disabled
number_slider_41 = Slider(0.06, range=0..1)  # disabled
srfsplit_3 = SurfaceSplit(Surface=brec_2.Bounding, Curves=path_mapper_2)  # disabled
extr_9 = Extrude(Base=srf_9, Direction=Z_6)
extr_10 = Extrude(Base=srf_8, Direction=Z_6)
scale_far = Slider(0.1, range=0..1)
scale_close = Slider(0.6, range=0..1)
attractor = Curve(<curve referenced from the Rhino model>)
unit_count = Slider(3, range=0..10)
crv_16 = Curve(srfsplit_3)  # disabled
mod_lower = Geometry(extr_9)
mod_upper = Geometry(extr_10)
area_3 = Area(Geometry=crv_16)  # -> Area, Centroid; disabled
point_attractor = PointAttractor(A_2=evalsrf.Point, B_2=area_3.Centroid, A=number_slider_40, B=number_slider_41)  # disabled
arrlinear_5 = LinearArray(Geometry=extr_10, Direction=Z_6, Count=unit_count)  # -> Geometry, Transform
scale = Scale(Geometry=crv_16, Center=area_3.Centroid, Factor=point_attractor)  # -> Geometry, Transform; disabled
mod_ary_upper = Geometry(arrlinear_5.Geometry)
number_slider_42 = Slider(90, range=0..100)
mod_ary_lower = Geometry(extr_9)
xz_4 = XZPlane(Origin=Point(0, 0, 0))
brec_4 = BoundingRectangle(Geometry=arrlinear_5.Geometry, Plane=xz_4, Axis=0, Slide=0, Union=True)  # -> Bounding, DimensionX, DimensionY
fac_width = Number(brec_4.DimensionX)
fac_height = Number(brec_4.DimensionY)
rectangle_10 = Rectangle(Plane=PlaneXY(0, 0, 0), XSize=fac_width, YSize=fac_height, Radius=0)  # -> Rectangle, Length
boundpanel = BoundPanel(Bnd=rectangle_10.Rectangle, SheetX=mod_width_2, SheetY=mod_height_2)  # -> Panels; inputs Bnd: Curve, SheetX: Double, SheetY: Double, UseWorldXY: Boolean; same code as boundary_panel
modules = Curve(boundpanel)
boundpanel_2 = BoundPanel(Bnd=boundpanel, SheetX=division_4, SheetY=mod_height_2)  # -> Panels; inputs Bnd: Curve, SheetX: Double, SheetY: Double, UseWorldXY: Boolean; same code as boundary_panel
offset_9 = OffsetCurve(Curve=boundpanel_2, Distance=neg_17, Corners=1)
offset_10 = OffsetCurve(Curve=boundpanel_2, Distance=neg_18, Corners=1)
boundary_3 = BoundarySurfaces(Edges=flatten([offset_10, boundpanel]))
crv_17 = Curve(offset_9)
grid_in_region_2 = GridInRegion(B=crv_17, RadX=cell_rad, Type=grid_type)  # -> simplify(GridCells), R, C; inputs B: Curve, RadX: Double, RadY: Double, Type: Boolean; same code as grid_in_region
area_4 = Area(Geometry=grid_in_region_2.GridCells)  # -> Area, Centroid
geo_12 = Geometry(flatten(boundary_3))
curve_attractor = CurveAttractor(C=attractor, P=area_4.Centroid, A=scale_close, B=scale_far)  # -> R, points_on_curve_2
scale_2 = Scale(Geometry=grid_in_region_2.GridCells, Center=area_4.Centroid, Factor=curve_attractor.R)  # -> Geometry, Transform
crv_18 = Curve(scale.Geometry)  # disabled
X_3 = UnitX(Factor=1)
rot3d = Rotate3D(Geometry=geo_12, Angle=degrees(number_slider_42), Center=Point(0, 0, 0), Axis=X_3)  # -> Geometry, Transform
vec = Vector(Z_6)
move_6 = Move(Geometry=rot3d.Geometry, Motion=vec)  # -> Geometry, Transform
rot3d_2 = Rotate3D(Geometry=scale_2.Geometry, Angle=degrees(number_slider_42), Center=Point(0, 0, 0), Axis=X_3)  # -> Geometry, Transform
rot3d_3 = Rotate3D(Geometry=[scale_2.Geometry, offset_9], Angle=degrees(number_slider_42), Center=Point(0, 0, 0), Axis=X_3)  # -> Geometry, Transform
geo_13 = Geometry(move_6.Geometry)
move_7 = Move(Geometry=rot3d_2.Geometry, Motion=vec)  # -> Geometry, Transform
move_8 = Move(Geometry=rot3d_3.Geometry, Motion=vec)  # -> Geometry, Transform
Y_6 = UnitY(Factor=Slider(1, range=0..10))
panels = Curve(move_8.Geometry)
neg_19 = Negative(Value=Y_6)
extr_11 = Extrude(Base=geo_13, Direction=neg_19)
move_9 = Move(Geometry=flatten([move_7.Geometry, move_8.Geometry]), Motion=neg_19)  # -> Geometry, Transform
geo_14 = Geometry(extr_11)
grid = Curve(move_9.Geometry)

# ==== cluster PointAttractor: Utility
A = ClusterInput()
x = ClusterInput()
A_2 = ClusterInput()
B = ClusterInput()
B_2 = ClusterInput()
dist = Distance(PointA=A_2, PointB=B_2)
dom = ConstructDomain(DomainStart=A, DomainEnd=B)
bnd = Bounds(Numbers=dist)
remap = RemapNumbers(Value=dist, Source=bnd, Target=dom)  # -> Mapped, Clipped
R = ClusterOutput(remap.Mapped)

# ==== cluster CurveAttractor: Utility
C = ClusterInput()
P = ClusterInput()
x = ClusterInput()
A = ClusterInput()
B = ClusterInput()
crv_cp = CurveClosestPoint(Point=P, Curve=C)  # -> Point, Parameter, Distance
dom = ConstructDomain(DomainStart=A, DomainEnd=B)
bnd = Bounds(Numbers=crv_cp.Distance)
remap = RemapNumbers(Value=crv_cp.Distance, Source=bnd, Target=dom)  # -> Mapped, Clipped
R = ClusterOutput(remap.Mapped)
points_on_curve = Point(crv_cp.Point)
points_on_curve_2 = ClusterOutput(points_on_curve)
