# Grasshopper definition parametric-sandbox-v0.6-general.gh (Grasshopper 1.0.8)
# plug-ins: Pufferfish, LunchBox

view = View(<view referenced from the Rhino model>, ViewSource=0)
rectangle = Rectangle(Plane=PlaneXY(0, 0, 0), XSize=Slider(240, range=0..1000), YSize=Slider(144, range=0..1000), Radius=0)  # -> Rectangle, Length
bldg_model = Geometry([<extrusion referenced from the Rhino model>, <brep referenced from the Rhino model> x3])
frame_a = Geometry([<extrusion referenced from the Rhino model> x9])
frame_b = Geometry([<extrusion referenced from the Rhino model> x36])
perf_pan = Geometry([<surface referenced from the Rhino model> x9])
frame_c = Geometry([<extrusion referenced from the Rhino model> x36])
num = Number(Slider(240, range=0..1000))
num_2 = Number(Slider(144, range=0..1000))
num_3 = Number(Slider(3, range=0..10))
num_4 = Number(Slider(72, range=0..1000))
num_5 = Number(Slider(144, range=0..1000))
multiplication = Multiplication(A=num_2, B=num_3)
prim_rect = Curve(rectangle.Rectangle)
number_slider = Slider(2, range=0..10)
make2d = Make2D(Geometry=bldg_model, View=view, TangentEdges=False, TangentSeams=False, AutoComputeMake2D=False)  # -> VisibleCurves, VisibleIndex, VisibleType, HiddenCurves, HiddenIndex, HiddenType
make2d_2 = Make2D(Geometry=frame_a, View=view, TangentEdges=False, TangentSeams=False, AutoComputeMake2D=False)  # -> VisibleCurves, VisibleIndex, VisibleType, HiddenCurves, HiddenIndex, HiddenType
make2d_3 = Make2D(Geometry=frame_b, View=view, TangentEdges=False, TangentSeams=False, AutoComputeMake2D=False)  # -> VisibleCurves, VisibleIndex, VisibleType, HiddenCurves, HiddenIndex, HiddenType
make2d_4 = Make2D(Geometry=frame_c, View=view, TangentEdges=False, TangentSeams=False, AutoComputeMake2D=False)  # -> VisibleCurves, VisibleIndex, VisibleType, HiddenCurves, HiddenIndex, HiddenType
make2d_5 = Make2D(Geometry=perf_pan, View=view, TangentEdges=False, TangentSeams=False, AutoComputeMake2D=False)  # -> VisibleCurves, VisibleIndex, VisibleType, HiddenCurves, HiddenIndex, HiddenType
rectangle_2 = Rectangle(Plane=PlaneXY(0, 0, 0), XSize=num, YSize=multiplication, Radius=0)  # -> Rectangle, Length
division = Division(A=num, B=num_4)
division_2 = Division(A=multiplication, B=num_5)
crv = Curve(prim_rect)
crv_2 = Curve(prim_rect)
crv_3 = Curve(make2d_2.VisibleCurves)
crv_4 = Curve(make2d.VisibleCurves)
crv_5 = Curve(make2d_3.VisibleCurves)
crv_6 = Curve(make2d_4.VisibleCurves)
crv_7 = Curve(make2d_5.VisibleCurves)
prim_rect_2 = Curve(rectangle_2.Rectangle)
bound_pan_offsets = BoundPanOffsets(bound=crv, prim_offset=number_slider, rect_div_x=Slider(3, range=0..10), rect_div_y=Slider(2, range=0..10))  # -> offset_curves_2, interior_curves_2
bound_pan_offsets_2 = BoundPanOffsets(bound=crv_2, prim_offset=Slider(4, range=0..10), rect_div_x=Slider(3, range=0..10), rect_div_y=Slider(1, range=0..10))  # -> offset_curves_2, interior_curves_2
crv_8 = Curve(bound_pan_offsets_2.interior_curves_2)
bound_pan_offsets_3 = BoundPanOffsets(bound=crv_8, prim_offset=Slider(1, range=0..10), rect_div_x=Slider(6, range=0..10), rect_div_y=Slider(2, range=0..10))  # -> offset_curves_2, interior_curves_2
grid = GridStructure(Surface=prim_rect_2, UDivisions=division, VDivisions=division_2)  # -> StructureLines, StructureNodes
neg = Negative(Value=number_slider)
srfsplit = SurfaceSplit(Surface=prim_rect_2, Curves=grid.StructureLines)
crv_9 = Curve(bound_pan_offsets.interior_curves_2)
number_slider_2 = Slider(2, range=0..10)
merge = Merge(Data1=neg, Data2=number_slider, Data3=number_slider, Data4=neg)
merge_2 = Merge(Data1=neg, Data2=neg, Data3=number_slider, Data4=number_slider)
brec = BoundingRectangle(Geometry=graft(srfsplit), Plane=PlaneXY(0, 0, 0), Axis=0, Slide=0, Union=True)  # -> Bounding, DimensionX, DimensionY
disc = Discontinuity(Curve=crv_9, Level=1)  # -> Points, Parameters
rectangle_3 = Rectangle(Plane=disc.Points, XSize=merge, YSize=merge_2, Radius=0)  # -> flatten(Rectangle), Length
crv_10 = Curve(brec.Bounding)
num_6 = Number(number_slider_2)
num_7 = Number(number_slider_2)
num_8 = Number(Slider(3, range=0..10))
neg_2 = Negative(Value=num_7)
neg_3 = Negative(Value=num_8)
neg_4 = Negative(Value=num_6)
num_9 = Number(neg_2)
num_10 = Number(Slider(0.5, range=0..1))
num_11 = Number(neg_3)
offset = OffsetCurve(Curve=crv_10, Distance=neg_4, Corners=1)
neg_5 = Negative(Value=num_10)
crv_11 = Curve(crv_10)
crv_12 = Curve(offset)
disc_2 = Discontinuity(Curve=flatten(crv_10), Level=1)  # -> Points, Parameters
merge_3 = Merge(Data1=num_7, Data2=num_9, Data3=num_9, Data4=num_7)
merge_4 = Merge(Data1=num_7, Data2=num_7, Data3=num_9, Data4=num_9)
num_12 = Number(neg_5)
merge_5 = Merge(Data1=num_8, Data2=num_11, Data3=num_11, Data4=num_8)
merge_6 = Merge(Data1=num_8, Data2=num_8, Data3=num_11, Data4=num_11)
crv_13 = Curve(bound_pan_offsets.offset_curves_2)
crv_14 = Curve(bound_pan_offsets.interior_curves_2)
crv_15 = Curve(rectangle_3.Rectangle)
crv_16 = Curve(bound_pan_offsets_2.offset_curves_2)
crv_17 = Curve(bound_pan_offsets_2.interior_curves_2)
crv_18 = Curve(bound_pan_offsets_3.offset_curves_2)
crv_19 = Curve(bound_pan_offsets_3.interior_curves_2)
merge_7 = Merge(Data1=flatten(crv_11), Data2=flatten(crv_12))
rectangle_4 = Rectangle(Plane=disc_2.Points, XSize=merge_3, YSize=merge_4, Radius=0)  # -> Rectangle, Length
offset_2 = OffsetCurve(Curve=crv_10, Distance=num_12, Corners=1)
rectangle_5 = Rectangle(Plane=disc_2.Points, XSize=merge_5, YSize=merge_6, Radius=0)  # -> Rectangle, Length

frame_b_2 = Curve(flatten(rectangle_4.Rectangle))
frame_c_2 = Curve(flatten(rectangle_5.Rectangle))
frame_a_2 = Curve(merge_7)

crv_20 = Curve(offset_2)
pan_a = Curve(flatten(crv_20))
num_13 = Number(Slider(4, range=0..100))
boundgrid = BoundGrid(B=crv_20, RadX=num_13, Type=2)  # -> GridCells, R, C; inputs B: Curve, RadX: Double, RadY: Double, Type: Boolean
# ---------- boundgrid: Python ----------
import math
import Rhino
from Rhino.Geometry import Point3d, Polyline, PolylineCurve
from Rhino.Geometry.Intersect import Intersection
from Grasshopper import DataTree
from Grasshopper.Kernel.Data import GH_Path

def _is_closed_planar(crv, tol):
    if crv is None: return False
    if not crv.IsClosed: return False
    ok, _ = crv.TryGetPlane(tol)
    return ok

def _curve_plane(crv, tol):
    ok, pln = crv.TryGetPlane(tol)
    return pln if ok else None

def _hex_pts_xy(cx, cy, rx, ry):
    # pointy-top hex; rx stretches X, ry stretches Y
    pts = []
    for k in range(6):
        ang = math.radians(30.0 + 60.0 * k)
        pts.append((cx + rx * math.cos(ang), cy + ry * math.sin(ang)))
    return pts

def _rect_pts_xy(cx, cy, rx, ry):
    # axis-aligned rectangle; if rx==ry it's a square
    return [
        (cx - rx, cy - ry),
        (cx + rx, cy - ry),
        (cx + rx, cy + ry),
        (cx - rx, cy + ry),
    ]

def _poly_fully_inside(cell_crv, boundary, plane, tol):
    ok, pl = cell_crv.TryGetPolyline()
    if not ok:
        return False

    # all vertices must be inside (or on boundary)
    for i in range(pl.Count - 1):
        if boundary.Contains(pl[i], plane, tol) == Rhino.Geometry.PointContainment.Outside:
            return False

    # any intersection (including touching) rejects
    x = Intersection.CurveCurve(cell_crv, boundary, tol, tol)
    if x and x.Count > 0:
        return False

    return True

# ----------------------------
# Main
# ----------------------------
GridCells = []
R = DataTree[object]()  # rows
C = DataTree[object]()  # cols

if B is None or RadX is None:
    GridCells = []
else:
    tol = Rhino.RhinoDoc.ActiveDoc.ModelAbsoluteTolerance if Rhino.RhinoDoc.ActiveDoc else 1e-6

    rx = float(RadX)
    if rx <= 0.0:
        GridCells = []
    else:
        # Critical rule: if RadY == 0 -> regular polygons
        if RadY is None:
            ry = rx
        else:
            ry_in = float(RadY)
            ry = rx if abs(ry_in) <= tol else ry_in

        if not _is_closed_planar(B, tol):
            GridCells = []
        else:
            plane = _curve_plane(B, tol)

            # boundary plane coords -> World XY
            xform_w2p = Rhino.Geometry.Transform.ChangeBasis(plane, Rhino.Geometry.Plane.WorldXY)
            xform_p2w = Rhino.Geometry.Transform.ChangeBasis(Rhino.Geometry.Plane.WorldXY, plane)

            B2 = B.DuplicateCurve()
            B2.Transform(xform_w2p)

            mp = Rhino.Geometry.AreaMassProperties.Compute(B2)
            ctr2 = mp.Centroid if mp else B2.GetBoundingBox(True).Center

            use_hex = True if Type else False

            # Grid spacing derived from rx/ry
            if use_hex:
                dx = math.sqrt(3.0) * rx
                dy = 1.5 * ry
            else:
                dx = 2.0 * rx
                dy = 2.0 * ry

            bb = B2.GetBoundingBox(True)
            minx = bb.Min.X - 2.0 * dx
            maxx = bb.Max.X + 2.0 * dx
            miny = bb.Min.Y - 2.0 * dy
            maxy = bb.Max.Y + 2.0 * dy

            j_min = int(math.floor((miny - ctr2.Y) / dy)) - 1
            j_max = int(math.ceil((maxy - ctr2.Y) / dy)) + 1
            i_min = int(math.floor((minx - ctr2.X) / dx)) - 1
            i_max = int(math.ceil((maxx - ctr2.X) / dx)) + 1

            cells_by_row = {}  # j -> list of (i, curve)
            cells_by_col = {}  # i -> list of (j, curve)

            for j in range(j_min, j_max + 1):
                y = ctr2.Y + j * dy
                row_offset = (0.5 * dx if (use_hex and (j & 1)) else 0.0)

                for i in range(i_min, i_max + 1):
                    x = ctr2.X + i * dx + row_offset
                    cpt2 = Point3d(x, y, 0.0)

                    # quick cull: center must be inside
                    if B2.Contains(cpt2, Rhino.Geometry.Plane.WorldXY, tol) == Rhino.Geometry.PointContainment.Outside:
                        continue

                    # build candidate cell in plane coords (WorldXY)
                    if use_hex:
                        verts = _hex_pts_xy(x, y, rx, ry)
                    else:
                        verts = _rect_pts_xy(x, y, rx, ry)

                    pts = [Point3d(vx, vy, 0.0) for (vx, vy) in verts]
                    pts.append(pts[0])

                    pline = Polyline(pts)
                    if not pline.IsValid:
                        continue

                    cell2 = PolylineCurve(pline)

                    if not _poly_fully_inside(cell2, B2, Rhino.Geometry.Plane.WorldXY, tol):
                        continue

                    cell_w = cell2.DuplicateCurve()
                    cell_w.Transform(xform_p2w)

                    GridCells.append(cell_w)
                    cells_by_row.setdefault(j, []).append((i, cell_w))
                    cells_by_col.setdefault(i, []).append((j, cell_w))

            # Rows -> R (branches ordered by j, items ordered by i)
            row_keys = sorted(cells_by_row.keys())
            for r_idx, j in enumerate(row_keys):
                path = GH_Path(r_idx)
                for (_, crv) in sorted(cells_by_row[j], key=lambda t: t[0]):
                    R.Add(crv, path)

            # Cols -> C (branches ordered by i, items ordered by j)
            col_keys = sorted(cells_by_col.keys())
            for c_idx, i in enumerate(col_keys):
                path = GH_Path(c_idx)
                for (_, crv) in sorted(cells_by_col[i], key=lambda t: t[0]):
                    C.Add(crv, path)
# ---------- end boundgrid ----------
crv_21 = Curve(<curve referenced from the Rhino model>)
area = Area(Geometry=boundgrid.GridCells)  # -> Area, Centroid
curve_attractor = CurveAttractor(C=crv_21, P=area.Centroid, A=Slider(0.3, range=0..1), B=Slider(0.7, range=0..1))  # -> R, points_on_curve_2
crv_22 = Curve(crv_14)
scale = Scale(Geometry=boundgrid.GridCells, Center=area.Centroid, Factor=curve_attractor.R)  # -> Geometry, Transform
offset_3 = OffsetCurve(Curve=crv_22, Distance=Slider(0.75, range=0..1), Corners=1)

patt_a = Curve(boundgrid.GridCells)
patt_b = Curve(scale.Geometry)

boundgrid_2 = BoundGrid(B=offset_3, RadX=Slider(3, range=0..10), Type=Slider(2, range=0..10))  # -> GridCells, R, C; inputs B: Curve, RadX: Double, RadY: Double, Type: Boolean; same code as boundgrid
crv_23 = Curve(offset_3)
crv_24 = Curve(boundgrid_2.GridCells)
area_2 = Area(Geometry=crv_24)  # -> Area, Centroid
scale_2 = Scale(Geometry=crv_24, Center=area_2.Centroid, Factor=0.5)  # -> Geometry, Transform

# ==== cluster BoundPanOffsets
prim_offset = ClusterInput()
rect_div_y = ClusterInput()
rect_div_x = ClusterInput()
bound = ClusterInput()
prim_offset_2 = Number(prim_offset)
rect_div_x_2 = Number(rect_div_x)
rect_div_y_2 = Number(rect_div_y)
bound_2 = Curve(bound)
brec = BoundingRectangle(Geometry=bound_2, Plane=PlaneXY(0, 0, 0), Axis=0, Slide=0, Union=True)  # -> Bounding, DimensionX, DimensionY
neg = Negative(Value=prim_offset_2)
division = Division(A=prim_offset_2, B=2)
neg_2 = Negative(Value=division)
division_2 = Division(A=brec.DimensionX, B=rect_div_x_2)
division_3 = Division(A=brec.DimensionY, B=rect_div_y_2)
boundpanel = BoundPanel(Bnd=bound_2, SheetX=division_2, SheetY=division_3)  # -> Panels; inputs Bnd: Curve, SheetX: Double, SheetY: Double, UseWorldXY: Boolean
# ---------- boundpanel: Python ----------
import Rhino
import scriptcontext as sc
from Rhino.Geometry import Plane, Rectangle3d, Interval

# Inputs:
#   Bnd        : Curve
#   SheetX     : float
#   SheetY     : float
#   UseWorldXY : bool
#
# Output:
#   Panels     : list[Curve]


def _doc_tol():
    if sc.doc:
        return sc.doc.ModelAbsoluteTolerance
    if Rhino.RhinoDoc.ActiveDoc:
        return Rhino.RhinoDoc.ActiveDoc.ModelAbsoluteTolerance
    return 1e-3


def sizes_1d(L, S, tol):
    """
    Fills length L with:
    - as many full sheets S as possible
    - remainder split equally into two end caps
    - full sheets centered between caps
    """
    if S <= tol:
        return [L]

    n_full = int(L // S)
    rem = L - (n_full * S)

    if abs(rem) <= tol:
        return [S] * n_full

    cap = 0.5 * rem

    if cap <= tol:
        return [S] * n_full

    return [cap] + ([S] * n_full) + [cap]


Panels = []

if Bnd is None:
    Panels = []
else:
    tol = _doc_tol()

    # Choose working plane
    if UseWorldXY:
        pl = Plane.WorldXY
    else:
        ok, pl = Bnd.TryGetPlane(tol)
        if not ok:
            pl = Plane.WorldXY

    # Bounding box in chosen plane
    bb = Bnd.GetBoundingBox(pl)

    Lx = bb.Max.X - bb.Min.X
    Ly = bb.Max.Y - bb.Min.Y

    x_sizes = sizes_1d(Lx, float(SheetX), tol)
    y_sizes = sizes_1d(Ly, float(SheetY), tol)

    x0 = bb.Min.X
    for sx in x_sizes:
        y0 = bb.Min.Y
        for sy in y_sizes:
            rect = Rectangle3d(
                pl,
                Interval(x0, x0 + sx),
                Interval(y0, y0 + sy)
            )
            Panels.append(rect.ToNurbsCurve())
            y0 += sy
        x0 += sx
# ---------- end boundpanel ----------
offset = OffsetCurve(Curve=boundpanel, Distance=neg_2, Corners=1)
offset_2 = OffsetCurve(Curve=bound_2, Distance=neg, Corners=1)
boundary = BoundarySurfaces(Edges=flatten([bound_2, offset_2]))
boundary_2 = BoundarySurfaces(Edges=flatten([offset, boundpanel]))
sunion = SolidUnion(Breps=[boundary, boundary_2])
edges = BrepEdges(Brep=sunion)  # -> Naked, Interior, NonManifold
join = JoinCurves(Curves=edges.Naked, Preserve=False)
area = Area(Geometry=join)  # -> Area, Centroid
avr = Average(Input=area.Area)
larger = LargerThan(FirstNumber=area.Area, SecondNumber=0)  # -> LargerThan, OrEqualTo
smaller = SmallerThan(FirstNumber=area.Area, SecondNumber=avr)  # -> SmallerThan, OrEqualTo
cull = CullPattern(List=join, CullPattern=smaller.SmallerThan)
offset_curves = Curve(flatten(join))
brec_2 = BoundingRectangle(Geometry=graft(cull), Plane=PlaneXY(0, 0, 0), Axis=0, Slide=0, Union=True)  # -> Bounding, DimensionX, DimensionY
interior_curves = Curve(flatten(brec_2.Bounding))
offset_curves_2 = ClusterOutput(offset_curves)
interior_curves_2 = ClusterOutput(interior_curves)

# ==== cluster CurveAttractor: Utility
C = ClusterInput()
P = ClusterInput()
x = ClusterInput()
A = ClusterInput()
B = ClusterInput()
crv_cp = CurveClosestPoint(Point=P, Curve=C)  # -> Point, Parameter, Distance
dom = ConstructDomain(DomainStart=A, DomainEnd=B)
bnd = Bounds(Numbers=crv_cp.Distance)
remap = RemapNumbers(Value=crv_cp.Distance, Source=bnd, Target=dom)  # -> Mapped, Clipped
R = ClusterOutput(remap.Mapped)
points_on_curve = Point(crv_cp.Point)
points_on_curve_2 = ClusterOutput(points_on_curve)
