# Grasshopper definition parametric-sandbox-v0.6-make2d.gh (Grasshopper 1.0.8)

geo = Geometry(<brep referenced from the Rhino model>)
geo_2 = Geometry([<extrusion referenced from the Rhino model> x36])
geo_3 = Geometry([<surface referenced from the Rhino model> x9])
geo_4 = Geometry([<extrusion referenced from the Rhino model> x9])
geo_5 = Geometry([<extrusion referenced from the Rhino model> x36])
view = View(<view referenced from the Rhino model>, ViewSource=1)
make2d = Make2D(Geometry=geo, View=view, TangentEdges=False, TangentSeams=False, AutoComputeMake2D=False)  # -> VisibleCurves, VisibleIndex, VisibleType, HiddenCurves, HiddenIndex, HiddenType
make2d_2 = Make2D(Geometry=geo_4, View=view, TangentEdges=False, TangentSeams=False, AutoComputeMake2D=False)  # -> VisibleCurves, VisibleIndex, VisibleType, HiddenCurves, HiddenIndex, HiddenType
make2d_3 = Make2D(Geometry=geo_5, View=view, TangentEdges=False, TangentSeams=False, AutoComputeMake2D=False)  # -> VisibleCurves, VisibleIndex, VisibleType, HiddenCurves, HiddenIndex, HiddenType
make2d_4 = Make2D(Geometry=geo_2, View=view, TangentEdges=False, TangentSeams=False, AutoComputeMake2D=False)  # -> VisibleCurves, VisibleIndex, VisibleType, HiddenCurves, HiddenIndex, HiddenType
make2d_5 = Make2D(Geometry=geo_3, View=view, TangentEdges=False, TangentSeams=False, AutoComputeMake2D=False)  # -> VisibleCurves, VisibleIndex, VisibleType, HiddenCurves, HiddenIndex, HiddenType
crv = Curve(make2d.VisibleCurves)
crv_2 = Curve(make2d_2.VisibleCurves)
crv_3 = Curve(make2d_3.VisibleCurves)
crv_4 = Curve(make2d_4.VisibleCurves)
crv_5 = Curve(make2d_5.VisibleCurves)
